# Dynamo graph 230315_ClashDetection.dyn (Dynamo 2.10.1.3976)

# group: IN
string = StringInput("C:\Users\pasic\Google Drive\0-FORMACION\ITTI-Automatizacion en Procesos BIM\RECURSOS\M11_TFM\WIP")
code_block = CodeBlock { "rvt"; }

# group: Buscar archivos y Recargar vínculos
python_script = Python(IN[0]=string, IN[1]=code_block)  # IronPython2; frozen
# ---------- python_script.python (210 lines) ----------
# BIBLIOTECAS
# <<<<<<<<<<<<<<<<<<<<<<<<<<<<<<<<<<<<<<<<<<<<<<<<<<<<<<<<<<<<<<<<<<<<<<<<

import clr # CommonLanguage Runtime
import os

# Para trabajar con geometrias en Dynamo
clr.AddReference('ProtoGeometry')
from Autodesk.DesignScript.Geometry import *

# Para trabajar con nodos de DSCore Node: List, Math, etc
clr.AddReference('DSCoreNodes')
import DSCore
from DSCore import *

# Para trabajar con nodos nativos de Revit: Ojo con las conversiones
clr.AddReference('RevitNodes')
import Revit
clr.ImportExtensions(Revit.Elements) # nos permite trabajar con elementos
clr.ImportExtensions(Revit.GeometryConversion) # nos permite convertir geometrias

# Recurso para acceder a la API de Dynamo
clr.AddReference("DynamoRevitDS") # para acceder a la interfaz de Dynamo
import Dynamo

# Para trabajar con la RevitAPI
clr.AddReference('RevitAPI')
import Autodesk
from Autodesk.Revit.DB import *

# Para trabajar con la RevitAPIUI
clr.AddReference('RevitAPIUI') # para trabajar con la interfaz de Revit
import Autodesk
from Autodesk.Revit.UI import *

# Para trabajar contra el documento y hacer transacciones
clr.AddReference('RevitServices')
import RevitServices
from RevitServices.Persistence import DocumentManager
from RevitServices.Transactions import TransactionManager

# Identificadores
doc = DocumentManager.Instance.CurrentDBDocument # para llamar al documento
uiapp = DocumentManager.Instance.CurrentUIApplication # para actuar contra el documento
app = uiapp.Application # para trabajar con la interfaz
uidoc = uiapp.ActiveUIDocument # para seleccionar en el documento

# Mis funciones: nos podemos importar nuestro archivo llamado "Funciones.py"
import sys
sys.path.append(r"C:\Users\pasic\Documents\Dynamo\Funciones") # ruta del archivo "Funciones.py"
#import Funciones # hace referencia al archivo "Funciones.py"
#from Funciones import * # importamos las funciones que queramos o todas las funciones con el "*"

# Otras bibliotecas
import System
from System.Collections.Generic import * # Para generar iList (lista fuertemente tipada)

# Bibliotecas de Python
sys.path.append(r"C:\Python27\Lib") # aqui estan las bibliotecas que se generan al instalarse Python

# FUNCIONES
# <<<<<<<<<<<<<<<<<<<<<<<<<<<<<<<<<<<<<<<<<<<<<<<<<<<<<<<<<<<<<<<<<<<<<<<<

def buscar_archivosPorExtension(ruta, extension, sub=False):

	# Uso: Buscar todos los archivos en una ruta y con una extension dadas
	# Entradas:
		# ruta
		# extension
		# sub
		# bkup
	# Salidas:

	salida, valido, invalido, totalArchivos = [], [], [], []

	# Se recorren subcarpetas
	if sub:
		for ruta, carpetas, archivos in os.walk(ruta):
			for archivo in archivos:
				# Agrupamos archivos con extension buscada
				if archivo.endswith(extension):
					valido.append(archivo)
				# Agrupamos resto de archivos
				else:
					invalido.append(archivo)
				totalArchivos.append(archivo)

		# Comprobamos que haya archivos de la extension buscada
		# Caso1: No hay archivos
		if len(totalArchivos) == len(invalido):
			salida = "No hay archivos con la extension dada"
		# Caso2: Si hay archivos
		else:
			# Vemos si hay archivos repetidos con la extension buscada
			unicos = set(valido)
			# Caso1: No hay archivos repetidos
			if len(unicos) == len(valido):
				for a in valido:
					if extension == ".rvt" or extension == "rvt":
						if ".00" not in a:
							salida.append(a)
						else:
							pass
					else:
						salida.append(a)
			# Caso2: Si hay archivos repetidos
			else:
				duplicados, todos = [], []
				for a in valido:
					if a not in todos:
						todos.append(a)
					elif a in todos and a not in duplicados:
						duplicados.append(a)
					else:
						pass
				for d in duplicados:
					salida.append("El archivo {} se encuentra en varias carpetas".format(d))

	# No se recorren subcarpetas
	else:
		for item in os.listdir(ruta):
			if item.endswith(extension):
				valido.append(item)
			else:
				invalido.append(item)

		if len(os.listdir(ruta)) == len(invalido):
			salida = "No hay archivos con la extension dada"
		else:
			for i in valido:
				if extension == ".rvt" or extension == "rvt":
					if ".00" not in i:
						salida.append(i)
					else:
						pass
				else:
					salida.append(i)

	return salida

# <<<<<<<<<<<<<<<<<<<<<<<<<<<<<<<<<<<<<<<<<<<<<<<<<<<<<<<<<<<<<<<<<<<<<<<<

def recargar_Vinculos():

	# Uso: Recargar los vinculos en un modelo federado
	# Entradas:
	# Salidas:

	salida, enlaces, vinculos, vincNombre = [], [], [], []
	
	# Colectamos tipos de vinculo
	vincTipo = FilteredElementCollector(doc).OfClass(RevitLinkType) # TiposVinculo

	# Comprobamos que el modelo tenga vinculos
	if bool(vincTipo):

		# Descartamos los anidamientos
		for x in vincTipo:
			if x.IsNestedLink:
				enlaces.append(x) # anidamientos
			else:
				vinculos.append(x) # vinculos
	
		for v in vinculos:
			# Consultamos los nombres de los vinculos (descartando anidamientos)
			vincTipoNombre = v.get_Parameter(BuiltInParameter.SYMBOL_NAME_PARAM).AsString()
			vincNombre.append(vincTipoNombre)
	
			# Comprobamos el estado de los vinculos (descartando anidamientos)
			estado = v.GetLinkedFileStatus()
	
			# Caso1: Vinculo ya cargado
			if estado == LinkedFileStatus.Loaded:
				salida.append("El vinculo {} esta ya cargado".format(vincTipoNombre))
	
			# Caso2: Vinculo descargado
			elif estado == LinkedFileStatus.Unloaded:
				# Accedemos a todos los archivos del directorio para comprobar su ubicacion
				archivos = buscar_archivosPorExtension(ruta, extension, sub=False) # rutas de los archivos rvt

				# Caso1: El vinculo se encuentra en el directorio
				if vincTipoNombre in archivos:
					rutaArchivo = os.path.join(ruta, vincTipoNombre)
					modelPath = ModelPathUtils.ConvertUserVisiblePathToModelPath(rutaArchivo)
					accion = v.LoadFrom(modelPath, None)
					# Si el vinculo ha sido cargado
					if accion.LoadResult == LinkLoadResultType.LinkLoaded:
						salida.append("El vinculo {} ha sido cargado".format(vincTipoNombre))
					else:
						salida.append("El vinculo {} no ha sido cargado".format(vincTipoNombre))

				# Caso2: El vinculo no se encuentra en el directorio
				else:
					salida.append("El vinculo {} no se encuentra en el directorio".format(vincTipoNombre))

	else:
		salida = "El modelo no tiene ningun vinculo linkado"

	return vinculos, vincNombre, enlaces

# ENTRADA
# <<<<<<<<<<<<<<<<<<<<<<<<<<<<<<<<<<<<<<<<<<<<<<<<<<<<<<<<<<<<<<<<<<<<<<<<

ruta = IN[0] # ruta de los links
extension = IN[1] # extension archivos funcion

# SALIDA
# <<<<<<<<<<<<<<<<<<<<<<<<<<<<<<<<<<<<<<<<<<<<<<<<<<<<<<<<<<<<<<<<<<<<<<<<

OUT = recargar_Vinculos()
# ----------------------------------------

# group: Crear vista3D por vínculo
python_script_2 = Python(IN[0]=python_script)  # IronPython2
# ---------- python_script_2.python (144 lines) ----------
# BIBLIOTECAS
# <<<<<<<<<<<<<<<<<<<<<<<<<<<<<<<<<<<<<<<<<<<<<<<<<<<<<<<<<<<<<<<<<<<<<<<<

import clr # CommonLanguage Runtime
import os

# Para trabajar con geometrias en Dynamo
clr.AddReference('ProtoGeometry')
from Autodesk.DesignScript.Geometry import *

# Para trabajar con nodos de DSCore Node: List, Math, etc
clr.AddReference('DSCoreNodes')
import DSCore
from DSCore import *

# Para trabajar con nodos nativos de Revit: Ojo con las conversiones
clr.AddReference('RevitNodes')
import Revit
clr.ImportExtensions(Revit.Elements) # nos permite trabajar con elementos
clr.ImportExtensions(Revit.GeometryConversion) # nos permite convertir geometrias

# Recurso para acceder a la API de Dynamo
clr.AddReference("DynamoRevitDS") # para acceder a la interfaz de Dynamo
import Dynamo

# Para trabajar con la RevitAPI
clr.AddReference('RevitAPI')
import Autodesk
from Autodesk.Revit.DB import *

# Para trabajar con la RevitAPIUI
clr.AddReference('RevitAPIUI') # para trabajar con la interfaz de Revit
import Autodesk
from Autodesk.Revit.UI import *

# Para trabajar contra el documento y hacer transacciones
clr.AddReference('RevitServices')
import RevitServices
from RevitServices.Persistence import DocumentManager
from RevitServices.Transactions import TransactionManager

# Identificadores
doc = DocumentManager.Instance.CurrentDBDocument # para llamar al documento
uiapp = DocumentManager.Instance.CurrentUIApplication # para actuar contra el documento
app = uiapp.Application # para trabajar con la interfaz
uidoc = uiapp.ActiveUIDocument # para seleccionar en el documento

# Mis funciones: nos podemos importar nuestro archivo llamado "Funciones.py"
import sys
sys.path.append(r"C:\Users\pasic\Documents\Dynamo\Funciones") # ruta del archivo "Funciones.py"
#import Funciones # hace referencia al archivo "Funciones.py"
#from Funciones import * # importamos las funciones que queramos o todas las funciones con el "*"

# Otras bibliotecas
import System
from System.Collections.Generic import * # Para generar iList (lista fuertemente tipada)

# Bibliotecas de Python
sys.path.append(r"C:\Python27\Lib") # aqui estan las bibliotecas que se generan al instalarse Python

# FUNCIONES
# <<<<<<<<<<<<<<<<<<<<<<<<<<<<<<<<<<<<<<<<<<<<<<<<<<<<<<<<<<<<<<<<<<<<<<<<

def crear_Vista3DPorVinculo():

	# Uso: Crear una vista 3D por cada vinculo cargado en el modelo
	# Entradas:
	# Salidas:

	salida, vincLoadNombres, vistas3D, vistas3DNombres = [], [], [], []

	# Entradas
	vincTipo = vinculos # IN[0]

	# Comprobamos que exista IN[0]
	if bool(vincTipo):

		# Consultamos los nombres de las vistas3D que existen en el doc
		v3DDocNombres = [v.Name for v in FilteredElementCollector(doc).OfClass(View3D)]

		for v in vincTipo:

			# Almacenamos los nombres de los vinculos cargados
			vlNombre = v.get_Parameter(BuiltInParameter.SYMBOL_NAME_PARAM).AsString()
			vincLoadNombres.append(vlNombre)

			# Definimos el nombre de las vistas a crear
			v3DNombre = vlNombre.split(".")[0] + "_Vinculo"

			# Comprobamos que estos nombres no existen
			if v3DNombre not in v3DDocNombres:

				# Obtenemos el Id del tipo vista3D a crear
				# Colectamos tipos vista
				tiposVista = FilteredElementCollector(doc).OfClass(ViewFamilyType).ToElements() # tipos
				# Obtenemos familias de tipos vista
				tiposVistaNombres = [x.ViewFamily for x in tiposVista] # familias
				# Obtenemos Id del tipo vista 3D
				tipoVista3DId = [x.Id for x in tiposVista if str(x.ViewFamily) == "ThreeDimensional"][0] # IdVista3D

				TransactionManager.Instance.EnsureInTransaction(doc)
				# abrimos transaccion

				# Creamos las vistas
				v3D = View3D.CreateIsometric(doc, tipoVista3DId)
				vistas3D.append(v3D)

				# Clasificamos las vistas
				v3D.LookupParameter("Clasificacion01").Set("Trabajo")
				v3D.LookupParameter("Clasificacion02").Set("Auditoria")

				# Renombramos las vistas
				parVN = BuiltInParameter.VIEW_NAME
				v3D.get_Parameter(parVN).Set(v3DNombre)
				vistas3DNombres.append(v3DNombre)

				salida.append("La vista {} ha sido creada".format(str(v3DNombre)))

				TransactionManager.Instance.TransactionTaskDone()
				# cerramos transaccion

			else:
				vistas3DExist = FilteredElementCollector(doc).OfClass(View3D)
				for v in vistas3DExist:
					if v.Name == v3DNombre:
						vistas3D.append(v)
						vistas3DNombres.append(v)

				salida.append("La vista {} ya existe".format(str(v3DNombre)))

	else:
		salida = "El modelo no tiene ningun vinculo linkado"

	return vistas3D

# ENTRADA
# <<<<<<<<<<<<<<<<<<<<<<<<<<<<<<<<<<<<<<<<<<<<<<<<<<<<<<<<<<<<<<<<<<<<<<<<

vinculos = UnwrapElement(IN[0][0]) # vinculos

# SALIDA
# <<<<<<<<<<<<<<<<<<<<<<<<<<<<<<<<<<<<<<<<<<<<<<<<<<<<<<<<<<<<<<<<<<<<<<<<

OUT = crear_Vista3DPorVinculo()
# ----------------------------------------

# group: Crear plantilla vista por vínculo
python_script_3 = Python(IN[0]=python_script_2)  # IronPython2
# ---------- python_script_3.python (134 lines) ----------
# BIBLIOTECAS
# <<<<<<<<<<<<<<<<<<<<<<<<<<<<<<<<<<<<<<<<<<<<<<<<<<<<<<<<<<<<<<<<<<<<<<<<

import clr # CommonLanguage Runtime
import os

# Para trabajar con geometrias en Dynamo
clr.AddReference('ProtoGeometry')
from Autodesk.DesignScript.Geometry import *

# Para trabajar con nodos de DSCore Node: List, Math, etc
clr.AddReference('DSCoreNodes')
import DSCore
from DSCore import *

# Para trabajar con nodos nativos de Revit: Ojo con las conversiones
clr.AddReference('RevitNodes')
import Revit
clr.ImportExtensions(Revit.Elements) # nos permite trabajar con elementos
clr.ImportExtensions(Revit.GeometryConversion) # nos permite convertir geometrias

# Recurso para acceder a la API de Dynamo
clr.AddReference("DynamoRevitDS") # para acceder a la interfaz de Dynamo
import Dynamo

# Para trabajar con la RevitAPI
clr.AddReference('RevitAPI')
import Autodesk
from Autodesk.Revit.DB import *

# Para trabajar con la RevitAPIUI
clr.AddReference('RevitAPIUI') # para trabajar con la interfaz de Revit
import Autodesk
from Autodesk.Revit.UI import *

# Para trabajar contra el documento y hacer transacciones
clr.AddReference('RevitServices')
import RevitServices
from RevitServices.Persistence import DocumentManager
from RevitServices.Transactions import TransactionManager

# Identificadores
doc = DocumentManager.Instance.CurrentDBDocument # para llamar al documento
uiapp = DocumentManager.Instance.CurrentUIApplication # para actuar contra el documento
app = uiapp.Application # para trabajar con la interfaz
uidoc = uiapp.ActiveUIDocument # para seleccionar en el documento

# Mis funciones: nos podemos importar nuestro archivo llamado "Funciones.py"
import sys
sys.path.append(r"C:\Users\pasic\Documents\Dynamo\Funciones") # ruta del archivo "Funciones.py"
#import Funciones # hace referencia al archivo "Funciones.py"
#from Funciones import * # importamos las funciones que queramos o todas las funciones con el "*"

# Otras bibliotecas
import System
from System.Collections.Generic import * # Para generar iList (lista fuertemente tipada)

# Bibliotecas de Python
sys.path.append(r"C:\Python27\Lib") # aqui estan las bibliotecas que se generan al instalarse Python

# FUNCIONES
# <<<<<<<<<<<<<<<<<<<<<<<<<<<<<<<<<<<<<<<<<<<<<<<<<<<<<<<<<<<<<<<<<<<<<<<<

def crear_PlantillaPorVinculo():

	# Uso: Crear una plantilla por cada vinculo cargado en el modelo
	# Entradas:
	# Salidas:

	salida, v3DNombres, planVista, planVistaNombres, planVistaId = [], [], [], [], []

	# Entradas
	vistas3D = vistas # IN[0]

	# Comprobamos que exista IN[0]
	if bool(vistas3D):

		# Consultamos los nombres de las plantillas que existen en el doc
		vp3DDocNombres = [v.Name for v in FilteredElementCollector(doc).OfClass(View3D) if v.IsTemplate]

		for v in vistas3D:

			# Almacenamos los nombres de las vistas
			v3DNombre = v.get_Parameter(BuiltInParameter.VIEW_NAME).AsString()
			v3DNombres.append(v3DNombre)

			# Definimos el nombre de las plantillas a crear
			vpNombre = v3DNombre.split("_")[0] + "_Plantilla3D"
			
			# Comprobamos que estos nombres no existen
			if vpNombre not in vp3DDocNombres:

				TransactionManager.Instance.EnsureInTransaction(doc)
				# abrimos transaccion

				# Creamos las plantillas
				vp = v.CreateViewTemplate()
				planVista.append(vp)
				planVistaId.append(vp.Id)

				# Renombramos las plantillas
				parVN = BuiltInParameter.VIEW_NAME
				vp.get_Parameter(parVN).Set(vpNombre)
				planVistaNombres.append(vpNombre)

				salida.append("La plantilla {} ha sido creada".format(str(vpNombre)))

				TransactionManager.Instance.TransactionTaskDone()
				# cerramos transaccion

			else:
				vistas3DExist = FilteredElementCollector(doc).OfClass(View3D)
				for v in vistas3DExist:
					if v.Name == vpNombre and v.IsTemplate:
						planVista.append(v)
						planVistaNombres.append(v.Name)
						planVistaId.append(v.Id)

				salida.append("La plantilla {} ya existe".format(str(vpNombre)))

	else:
		salida = "Se han borrado las vistas de Auditoria"

	return planVistaId, planVistaNombres

# ENTRADA
# <<<<<<<<<<<<<<<<<<<<<<<<<<<<<<<<<<<<<<<<<<<<<<<<<<<<<<<<<<<<<<<<<<<<<<<<

vistas = UnwrapElement(IN[0]) # vistas3D

# SALIDA
# <<<<<<<<<<<<<<<<<<<<<<<<<<<<<<<<<<<<<<<<<<<<<<<<<<<<<<<<<<<<<<<<<<<<<<<<

OUT = crear_PlantillaPorVinculo()
# ----------------------------------------

# group: Aplicar plantilla vista por vínculo
python_script_4 = Python(IN[0]=python_script_3, IN[1]=python_script_2)  # IronPython2
# ---------- python_script_4.python (112 lines) ----------
# BIBLIOTECAS
# <<<<<<<<<<<<<<<<<<<<<<<<<<<<<<<<<<<<<<<<<<<<<<<<<<<<<<<<<<<<<<<<<<<<<<<<

import clr # CommonLanguage Runtime
import os

# Para trabajar con geometrias en Dynamo
clr.AddReference('ProtoGeometry')
from Autodesk.DesignScript.Geometry import *

# Para trabajar con nodos de DSCore Node: List, Math, etc
clr.AddReference('DSCoreNodes')
import DSCore
from DSCore import *

# Para trabajar con nodos nativos de Revit: Ojo con las conversiones
clr.AddReference('RevitNodes')
import Revit
clr.ImportExtensions(Revit.Elements) # nos permite trabajar con elementos
clr.ImportExtensions(Revit.GeometryConversion) # nos permite convertir geometrias

# Recurso para acceder a la API de Dynamo
clr.AddReference("DynamoRevitDS") # para acceder a la interfaz de Dynamo
import Dynamo

# Para trabajar con la RevitAPI
clr.AddReference('RevitAPI')
import Autodesk
from Autodesk.Revit.DB import *

# Para trabajar con la RevitAPIUI
clr.AddReference('RevitAPIUI') # para trabajar con la interfaz de Revit
import Autodesk
from Autodesk.Revit.UI import *

# Para trabajar contra el documento y hacer transacciones
clr.AddReference('RevitServices')
import RevitServices
from RevitServices.Persistence import DocumentManager
from RevitServices.Transactions import TransactionManager

# Identificadores
doc = DocumentManager.Instance.CurrentDBDocument # para llamar al documento
uiapp = DocumentManager.Instance.CurrentUIApplication # para actuar contra el documento
app = uiapp.Application # para trabajar con la interfaz
uidoc = uiapp.ActiveUIDocument # para seleccionar en el documento

# Mis funciones: nos podemos importar nuestro archivo llamado "Funciones.py"
import sys
sys.path.append(r"C:\Users\pasic\Documents\Dynamo\Funciones") # ruta del archivo "Funciones.py"
#import Funciones # hace referencia al archivo "Funciones.py"
#from Funciones import * # importamos las funciones que queramos o todas las funciones con el "*"

# Otras bibliotecas
import System
from System.Collections.Generic import * # Para generar iList (lista fuertemente tipada)

# Bibliotecas de Python
sys.path.append(r"C:\Python27\Lib") # aqui estan las bibliotecas que se generan al instalarse Python

# FUNCIONES
# <<<<<<<<<<<<<<<<<<<<<<<<<<<<<<<<<<<<<<<<<<<<<<<<<<<<<<<<<<<<<<<<<<<<<<<<

def aplicar_PlantillaPorVinculo():

	# Uso: Aplicar plantilla por cada vinculo cargado en el modelo
	# Entradas:
	# Salidas:

	salida = []

	# Entradas
	plantvistas3DId = plantillaId # IN[0][0]
	plantNombresvistas3D = plantillaNombres # IN[0][1]
	vistas3D = vistas # IN[1]

	if bool(vistas3D) and bool(plantvistas3DId) and bool(plantNombresvistas3D):

		for v,vpId,vpn in zip(vistas3D, plantvistas3DId, plantNombresvistas3D):

			TransactionManager.Instance.EnsureInTransaction(doc)
			# abrimos transaccion

			# Aplicamos las plantillas de vista si cumplimos la condicion
			if v.Name.split("_")[0] == vpn.split("_")[0]:

				parVT = BuiltInParameter.VIEW_TEMPLATE
				v.get_Parameter(parVT).Set(vpId)
				salida.append("Se ha aplicado la plantilla {} en la vista {}".format(vpn, v.Name))

			else:
				salida.append("No se encuentra la vista buscada")

			TransactionManager.Instance.TransactionTaskDone()
			# cerramos transaccion

	else:
		salida = "No existen las vistas de Auditoria"

	return salida

# ENTRADA
# <<<<<<<<<<<<<<<<<<<<<<<<<<<<<<<<<<<<<<<<<<<<<<<<<<<<<<<<<<<<<<<<<<<<<<<<

plantillaId = UnwrapElement(IN[0][0]) # plantillasvista3D
plantillaNombres = UnwrapElement(IN[0][1]) # plantillasvista3Dnombre
vistas = UnwrapElement(IN[1]) # vistas3D

# CODIGO
# <<<<<<<<<<<<<<<<<<<<<<<<<<<<<<<<<<<<<<<<<<<<<<<<<<<<<<<<<<<<<<<<<<<<<<<<

OUT = aplicar_PlantillaPorVinculo()
# ----------------------------------------

# group: Configurar plantilla vista por vínculo (WIP)
python_script_5 = Python()  # IronPython2; frozen
# ---------- python_script_5.python (580 lines) ----------
# BIBLIOTECAS
# <<<<<<<<<<<<<<<<<<<<<<<<<<<<<<<<<<<<<<<<<<<<<<<<<<<<<<<<<<<<<<<<<<<<<<<<

import clr # CommonLanguage Runtime
import os

# Para trabajar con geometrias en Dynamo
clr.AddReference('ProtoGeometry')
from Autodesk.DesignScript.Geometry import *

# Para trabajar con nodos de DSCore Node: List, Math, etc
clr.AddReference('DSCoreNodes')
import DSCore
from DSCore import *

# Para trabajar con nodos nativos de Revit: Ojo con las conversiones
clr.AddReference('RevitNodes')
import Revit
clr.ImportExtensions(Revit.Elements) # nos permite trabajar con elementos
clr.ImportExtensions(Revit.GeometryConversion) # nos permite convertir geometrias

# Recurso para acceder a la API de Dynamo
clr.AddReference("DynamoRevitDS") # para acceder a la interfaz de Dynamo
import Dynamo

# Para trabajar con la RevitAPI
clr.AddReference('RevitAPI')
import Autodesk
from Autodesk.Revit.DB import *

# Para trabajar con la RevitAPIUI
clr.AddReference('RevitAPIUI') # para trabajar con la interfaz de Revit
import Autodesk
from Autodesk.Revit.UI import *

# Para trabajar contra el documento y hacer transacciones
clr.AddReference('RevitServices')
import RevitServices
from RevitServices.Persistence import DocumentManager
from RevitServices.Transactions import TransactionManager

# Identificadores
doc = DocumentManager.Instance.CurrentDBDocument # para llamar al documento
uiapp = DocumentManager.Instance.CurrentUIApplication # para actuar contra el documento
app = uiapp.Application # para trabajar con la interfaz
uidoc = uiapp.ActiveUIDocument # para seleccionar en el documento

# Mis funciones: nos podemos importar nuestro archivo llamado "Funciones.py"
import sys
sys.path.append(r"C:\Users\pasic\Documents\Dynamo\Funciones") # ruta del archivo "Funciones.py"
#import Funciones # hace referencia al archivo "Funciones.py"
#from Funciones import * # importamos las funciones que queramos o todas las funciones con el "*"

# Otras bibliotecas
import System
from System.Collections.Generic import * # Para generar iList (lista fuertemente tipada)

# Bibliotecas de Python
sys.path.append(r"C:\Python27\Lib") # aqui estan las bibliotecas que se generan al instalarse Python

# FUNCIONES
# <<<<<<<<<<<<<<<<<<<<<<<<<<<<<<<<<<<<<<<<<<<<<<<<<<<<<<<<<<<<<<<<<<<<<<<<

def buscar_archivosPorExtension(ruta, extension, sub=False):

	# Uso: Buscar todos los archivos en una ruta y con una extension dadas
	# Entradas:
		# ruta
		# extension
		# sub
		# bkup
	# Salidas:

	salida, valido, invalido, totalArchivos = [], [], [], []

	# Se recorren subcarpetas
	if sub:
		for ruta, carpetas, archivos in os.walk(ruta):
			for archivo in archivos:
				# Agrupamos archivos con extension buscada
				if archivo.endswith(extension):
					valido.append(archivo)
				# Agrupamos resto de archivos
				else:
					invalido.append(archivo)
				totalArchivos.append(archivo)

		# Comprobamos que haya archivos de la extension buscada
		# Caso1: No hay archivos
		if len(totalArchivos) == len(invalido):
			salida = "No hay archivos con la extension dada"
		# Caso2: Si hay archivos
		else:
			# Vemos si hay archivos repetidos con la extension buscada
			unicos = set(valido)
			# Caso1: No hay archivos repetidos
			if len(unicos) == len(valido):
				for a in valido:
					if extension == ".rvt" or extension == "rvt":
						if ".00" not in a:
							salida.append(a)
						else:
							pass
					else:
						salida.append(a)
			# Caso2: Si hay archivos repetidos
			else:
				duplicados, todos = [], []
				for a in valido:
					if a not in todos:
						todos.append(a)
					elif a in todos and a not in duplicados:
						duplicados.append(a)
					else:
						pass
				for d in duplicados:
					salida.append("El archivo {} se encuentra en varias carpetas".format(d))

	# No se recorren subcarpetas
	else:
		for item in os.listdir(ruta):
			if item.endswith(extension):
				valido.append(item)
			else:
				invalido.append(item)

		if len(os.listdir(ruta)) == len(invalido):
			salida = "No hay archivos con la extension dada"
		else:
			for i in valido:
				if extension == ".rvt" or extension == "rvt":
					if ".00" not in i:
						salida.append(i)
					else:
						pass
				else:
					salida.append(i)

	return salida

# <<<<<<<<<<<<<<<<<<<<<<<<<<<<<<<<<<<<<<<<<<<<<<<<<<<<<<<<<<<<<<<<<<<<<<<<

def recargar_Vinculos():

	# Uso: Recargar los vinculos en un modelo federado
	# Entradas:
	# Salidas:

	salida, enlaces, vinculos = [], [], []
	
	# Colectamos tipos de vinculo
	vincTipo = FilteredElementCollector(doc).OfClass(RevitLinkType) # TiposVinculo

	# Comprobamos que el modelo tenga vinculos
	if bool(vincTipo):

		# Descartamos los anidamientos
		for x in vincTipo:
			if x.IsNestedLink:
				enlaces.append(x) # anidamientos
			else:
				vinculos.append(x) # vinculos
	
		for v in vinculos:
			# Consultamos los nombres de los vinculos (descartando anidamientos)
			vincTipoNombre = v.get_Parameter(BuiltInParameter.SYMBOL_NAME_PARAM).AsString()
	
			# Comprobamos el estado de los vinculos (descartando anidamientos)
			estado = v.GetLinkedFileStatus()
	
			# Caso1: Vinculo ya cargado
			if estado == LinkedFileStatus.Loaded:
				salida.append("El vinculo {} esta ya cargado".format(vincTipoNombre))
	
			# Caso2: Vinculo descargado
			elif estado == LinkedFileStatus.Unloaded:
				# Accedemos a todos los archivos del directorio para comprobar su ubicacion
				archivos = buscar_archivosPorExtension(ruta, extension, sub=False) # rutas de los archivos rvt

				# Caso1: El vinculo se encuentra en el directorio
				if vincTipoNombre in archivos:
					rutaArchivo = os.path.join(ruta, vincTipoNombre)
					modelPath = ModelPathUtils.ConvertUserVisiblePathToModelPath(rutaArchivo)
					accion = v.LoadFrom(modelPath, None)
					# Si el vinculo ha sido cargado
					if accion.LoadResult == LinkLoadResultType.LinkLoaded:
						salida.append("El vinculo {} ha sido cargado".format(vincTipoNombre))
					else:
						salida.append("El vinculo {} no ha sido cargado".format(vincTipoNombre))

				# Caso2: El vinculo no se encuentra en el directorio
				else:
					salida.append("El vinculo {} no se encuentra en el directorio".format(vincTipoNombre))

	else:
		salida = "El modelo no tiene ningun vinculo linkado"

	return salida

# <<<<<<<<<<<<<<<<<<<<<<<<<<<<<<<<<<<<<<<<<<<<<<<<<<<<<<<<<<<<<<<<<<<<<<<<

def enumerados_familiasVistas_Cpython():

	# Uso: crear un diccionario con las familias de vista (keys) y sus nombres (valores)
		# Nota: en "cpython", los enumerados vienen representados por un integer
	# Entrada:
	# Salida

	# Obtenemos los nombres de las familias de vista
	nombres = System.Enum.GetNames(ViewFamily) # valores dict

	# Obtenemos las familias
	familias = System.Enum.GetValues(ViewFamily) # keys dict

	# Casting de valores de familias
	claves = [str(f) for f in familias]
	# Nota: "cpython" saca enumerados con integer, hacemos str para almacenar como clave en dict

	return dict(zip(claves, nombres))

# <<<<<<<<<<<<<<<<<<<<<<<<<<<<<<<<<<<<<<<<<<<<<<<<<<<<<<<<<<<<<<<<<<<<<<<<

def id_tiposFamiliasVistas():

	# Uso: crear un diccionario con las familias de vista (claves) y los Id de sus tipos
	# Entrada:
	# Salida:

	# Colectamos los tipos de vista
	tiposVista = FilteredElementCollector(doc).OfClass(ViewFamilyType).ToElements() # tipos

	datos = dict()

	for tv in tiposVista:
		# Obtenemos las familias de los tipos de vista
		familiaVista = tv.ViewFamily # familias

		# Si trabajamos con cpyhton
		if sys.implementation.name == "cpython":
			# Accedemos al diccionario "enumerados_familiasVistas_Cpython()"
			diccionario = enumerados_familiasVistas_Cpython()
			# Sobreescribimos la variable familiaVista con un nuevo valor
			familiaVista = diccionario[str(familiaVista)]

		# Almacenamos los datos en el diccionario
		if familiaVista not in datos:
			datos[str(familiaVista)] = [tv.Id]
		else:
			datos[str(familiaVista)].append(tv.Id)

	return datos

# <<<<<<<<<<<<<<<<<<<<<<<<<<<<<<<<<<<<<<<<<<<<<<<<<<<<<<<<<<<<<<<<<<<<<<<<

def crear_VistayPlantilla3DPorVinculo():

	# Uso: Crear una vista 3D por cada vinculo cargado en el modelo
	# Entradas:
	# Salidas:

	salida, enlaces, vinculos = [], [], []
	
	# Colectamos tipos de vinculo
	vincTipo = FilteredElementCollector(doc).OfClass(RevitLinkType) # TiposVinculo

	# Comprobamos que el modelo tenga vinculos
	if bool(vincTipo):

		# Descartamos los anidamientos
		for x in vincTipo:
			if x.IsNestedLink:
				enlaces.append(x) # anidamientos
			else:
				vinculos.append(x) # vinculos

		# Generamos una vista3D por cada vinculo cargado en el modelo
		vtNombres, vistas3D, vistas3DNombres, vistas3DPlantNombres, plantillas = [], [], [], [], [] # listas vacias
		paramNoControl = List[ElementId]() # lita tipada vacia
		for v in vinculos:

			# Comprobamos el estado de los vinculos (descartando anidamientos)
			estado = v.GetLinkedFileStatus()
	
			# Caso1: Vinculo cargado
			if estado == LinkedFileStatus.Loaded:

				# Almacenamos los nombres de los vinculos (descartando anidamientos)
				vtNombre = v.get_Parameter(BuiltInParameter.SYMBOL_NAME_PARAM).AsString()
				vtNombres.append(vtNombre)

				# Colectamos los tipos de vista
				tiposVista = FilteredElementCollector(doc).OfClass(ViewFamilyType).ToElements() # tipos
				# Obtenemos las familias de los tipos
				tiposVistaNombres = [x.ViewFamily for x in tiposVista] # familias
				# Obtenemos el id del tipo de vista 3D
				tipoVista3DId = [x.Id for x in tiposVista if str(x.ViewFamily) == "ThreeDimensional"][0] # IdVista3D

				TransactionManager.Instance.EnsureInTransaction(doc)
				# abrimos transaccion

				# Creamos una vista 3D para cada vinculo cargado y las almacenamos junto a sus nombres
				v3D = View3D.CreateIsometric(doc, tipoVista3DId)
				vistas3D.append(v3D)

				parVN = BuiltInParameter.VIEW_NAME
				v3DNuevoNombre = vtNombre.split(".")[0] + "_Vinculo"
				v3D.get_Parameter(parVN).Set(v3DNuevoNombre)
				vistas3DNombres.append(v3DNuevoNombre)

				# Creamos una plantilla de vista por vinculo y la renombramos
				vp = v3D.CreateViewTemplate()

				parVN = BuiltInParameter.VIEW_NAME
				vpNuevoNombre = vtNombre.split(".")[0] + "_Plantilla3D"
				vp.get_Parameter(parVN).Set(vpNuevoNombre)
				vistas3DPlantNombres.append(vpNuevoNombre)
				
				# Aplicamos las plantillas de vista
				if v3D.Name.split("_")[0] == vp.Name.split("_")[0]:
					parVT = BuiltInParameter.VIEW_TEMPLATE
					v3D.get_Parameter(parVT).Set(vp.Id)
				else:
					pass

				# Obtenemos las plantillas de vista
				# idPlantilla = vp.Id
				# idPlantilla = v3D.ViewTemplateId
				plantilla = doc.GetElement(vp.Id)
				plantillas.append(plantilla)

				# Consultamos parametros no controlados por plantilla en las vistas
				# infoParametros = plantilla.GetNonControlledTemplateParameterIds()
				# paramNoControl.Add(infoParametros)

				TransactionManager.Instance.TransactionTaskDone()
				# cerramos transaccion

			# Caso2: Vinculo descargado
			else:
				pass

	else:
		salida = "El modelo no tiene ningun vinculo linkado"

	return vtNombres, vistas3D, vistas3DNombres, vistas3DPlantNombres, plantillas

# <<<<<<<<<<<<<<<<<<<<<<<<<<<<<<<<<<<<<<<<<<<<<<<<<<<<<<<<<<<<<<<<<<<<<<<<

def crear_Vista3DPorVinculo():

	# Uso: Crear una vista 3D por cada vinculo cargado en el modelo
	# Entradas:
	# Salidas:

	salida, enlaces, vinculos, vinculosLoaded, vinculosNotLoaded = [], [], [], [], []
	
	# Colectamos tipos de vinculo
	vincTipo = FilteredElementCollector(doc).OfClass(RevitLinkType) # TiposVinculo

	# Comprobamos que el modelo tenga vinculos
	if bool(vincTipo):

		# Descartamos los anidamientos
		for x in vincTipo:
			if x.IsNestedLink:
				enlaces.append(x) # anidamientos
			else:
				vinculos.append(x) # vinculos

		# Generamos una vista3D por cada vinculo cargado en el modelo
		vincLoadNombres, vistas3D, vistas3DNombres, vistas3DPlantNombres, plantillas = [], [], [], [], [] # listas vacias
		paramNoControl = List[ElementId]() # lita tipada vacia
		for v in vinculos:

			# Comprobamos el estado de los vinculos (descartando anidamientos)
			estado = v.GetLinkedFileStatus()
	
			# Caso1: Vinculo cargado
			if estado == LinkedFileStatus.Loaded:
				vinculosLoaded.append(v)

			# Caso2: Vinculo descargado
			else:
				vinculosNotLoaded.append(v)

		for v in vinculosLoaded:

			# Almacenamos los nombres de los vinculos cargados
			vlNombre = v.get_Parameter(BuiltInParameter.SYMBOL_NAME_PARAM).AsString()
			vincLoadNombres.append(vlNombre)
	
			# Colectamos los tipos de vista
			tiposVista = FilteredElementCollector(doc).OfClass(ViewFamilyType).ToElements() # tipos
			# Obtenemos las familias de los tipos
			tiposVistaNombres = [x.ViewFamily for x in tiposVista] # familias
			# Obtenemos el id del tipo de vista 3D
			tipoVista3DId = [x.Id for x in tiposVista if str(x.ViewFamily) == "ThreeDimensional"][0] # IdVista3D
	
			TransactionManager.Instance.EnsureInTransaction(doc)
			# abrimos transaccion
	
			# Creamos una vista 3D por vinculo cargado y las renombramos
			try:
				v3D = View3D.CreateIsometric(doc, tipoVista3DId)
				parVN = BuiltInParameter.VIEW_NAME
				v3DNombre = vlNombre.split(".")[0] + "_Vinculo"
				v3D.get_Parameter(parVN).Set(v3DNombre)

				v3D.LookupParameter("Clasificacion01").Set("Trabajo")
				v3D.LookupParameter("Clasificacion02").Set("Auditoria")

				vistas3D.append(v3D)
				vistas3DNombres.append(v3DNombre)
				salida.append("La vista {} ha sido creada".format(str(v3DNombre)))

			except:
				salida.append("La vista {} ya esta creada".format(str(v3DNombre))) # WIP
	
			TransactionManager.Instance.TransactionTaskDone()
			# cerramos transaccion

	else:
		salida = "El modelo no tiene ningun vinculo linkado"

	return salida

# <<<<<<<<<<<<<<<<<<<<<<<<<<<<<<<<<<<<<<<<<<<<<<<<<<<<<<<<<<<<<<<<<<<<<<<<

def crear_PlantillaPorVinculo():

	# Uso: Crear una plantilla por cada vinculo cargado en el modelo
	# Entradas:
	# Salidas:

	salida = []

	# Colectamos los tipos de vista
	colector = FilteredElementCollector(doc).OfClass(View)

	# Filtramos por las vistas buscadas
	vistas3D = [v for v in colector if v.ViewType == ViewType.ThreeD and v.LookupParameter("Clasificacion02").AsString() == "Auditoria" and not v.IsTemplate]

	if bool(vistas3D):

		for v in vistas3D:

			TransactionManager.Instance.EnsureInTransaction(doc)
			# abrimos transaccion

			# Creamos una plantilla de vista por vinculo y la renombramos
			vp = v.CreateViewTemplate()
			parVN = BuiltInParameter.VIEW_NAME
			vpNombre = v.Name.split("_")[0] + "_Plantilla3D"
			vp.get_Parameter(parVN).Set(vpNombre)

			salida.append(vp)

			TransactionManager.Instance.TransactionTaskDone()
			# cerramos transaccion

	else:
		salida = "Se han borrado las vistas de Auditoria"

	return salida

# <<<<<<<<<<<<<<<<<<<<<<<<<<<<<<<<<<<<<<<<<<<<<<<<<<<<<<<<<<<<<<<<<<<<<<<<

def configurar_PlantillaPorVinculo():

	# Uso: Crear una plantilla por cada vinculo cargado en el modelo
	# Entradas:
	# Salidas:

	salida, vistas3DPlantNombres = [], []

	# Colectamos los tipos de vista
	colector = FilteredElementCollector(doc).OfClass(View)

	# Filtramos por las vistas buscadas
	vistas3D = [v for v in colector if v.ViewType == ViewType.ThreeD and v.LookupParameter("Clasificacion02").AsString() == "Auditoria"]

	if bool(vistas3D):

		for v in vistas3D:

			TransactionManager.Instance.EnsureInTransaction(doc)
			# abrimos transaccion

			# Creamos una plantilla de vista por vinculo y la renombramos
			vp = v.CreateViewTemplate()
			parVN = BuiltInParameter.VIEW_NAME
			vpNombre = v.Name.split("_")[0] + "_Plantilla3D"
			vp.get_Parameter(parVN).Set(vpNombre)

			vistas3DPlantNombres.append(vpNombre)

			# Aplicamos las plantillas de vista si cumplimos la condicion
			if v.Name.split("_")[0] == vp.Name.split("_")[0]:
				try:
					parVT = BuiltInParameter.VIEW_TEMPLATE
					v.get_Parameter(parVT).Set(vp.Id)
					salida.append("Se ha aplicado la plantilla {} en la vista {}".format(vpNombre, v.Name))
				except:
					salida.append("La plantilla {} ya esta aplicada en la vista {}".format(vpNombre, v.Name))
			else:
				salida.append("No se encuentra la vista {} para aplicar la plantilla {}".format(v.Name, vpNombre))

			TransactionManager.Instance.TransactionTaskDone()
			# cerramos transaccion

	else:
		salida = "No existen las vistas de Auditoria"

	return salida

# <<<<<<<<<<<<<<<<<<<<<<<<<<<<<<<<<<<<<<<<<<<<<<<<<<<<<<<<<<<<<<<<<<<<<<<<

def aplicar_PlantillaPorVinculo():

	# Uso: Crear una plantilla por cada vinculo cargado en el modelo
	# Entradas:
	# Salidas:

	salida, vistas3DPlantNombres = [], []

	# Colectamos los tipos de vista
	colector = FilteredElementCollector(doc).OfClass(View)

	# Filtramos por las vistas buscadas
	vistas3D = [v for v in colector if v.ViewType == ViewType.ThreeD and v.LookupParameter("Clasificacion02").AsString() == "Auditoria" and not v.IsTemplate]

	if bool(vistas3D):

		for v in vistas3D:

			TransactionManager.Instance.EnsureInTransaction(doc)
			# abrimos transaccion

			# Creamos una plantilla de vista por vinculo y la renombramos
			vp = v.CreateViewTemplate()
			parVN = BuiltInParameter.VIEW_NAME
			vpNombre = v.Name.split("_")[0] + "_Plantilla3D"
			vp.get_Parameter(parVN).Set(vpNombre)

			vistas3DPlantNombres.append(vpNombre)

			# Aplicamos las plantillas de vista si cumplimos la condicion
			if v.Name.split("_")[0] == vp.Name.split("_")[0]:
				try:
					parVT = BuiltInParameter.VIEW_TEMPLATE
					v.get_Parameter(parVT).Set(vp.Id)
					salida.append("Se ha aplicado la plantilla {} en la vista {}".format(vpNombre, v.Name))
				except:
					salida.append("La plantilla {} ya esta aplicada en la vista {}".format(vpNombre, v.Name))
			else:
				salida.append("No se encuentra la vista {} para aplicar la plantilla {}".format(v.Name, vpNombre))

			TransactionManager.Instance.TransactionTaskDone()
			# cerramos transaccion

	else:
		salida = "No existen las vistas de Auditoria"

	return salida

# ENTRADA
# <<<<<<<<<<<<<<<<<<<<<<<<<<<<<<<<<<<<<<<<<<<<<<<<<<<<<<<<<<<<<<<<<<<<<<<<

ruta = IN[0] # ruta de los links
extension = IN[1] # extension archivos funcion

# CODIGO
# <<<<<<<<<<<<<<<<<<<<<<<<<<<<<<<<<<<<<<<<<<<<<<<<<<<<<<<<<<<<<<<<<<<<<<<<

# OUT = buscar_archivosPorExtension(ruta, extension, sub=False)
# OUT = recargar_Vinculos()
# OUT = crear_ParamVista3DPorVinculo() # FALTA
# OUT = crear_Vista3DPorVinculo()
# OUT = crear_PlantillaPorVinculo()
OUT = configurar_PlantillaPorVinculo()
# ----------------------------------------

# group: Categorías por vínculo
python_script_6 = Python(IN[0]=python_script)  # CPython3
# ---------- python_script_6.python (211 lines) ----------
# BIBLIOTECAS
# <<<<<<<<<<<<<<<<<<<<<<<<<<<<<<<<<<<<<<<<<<<<<<<<<<<<<<<<<<<<<<<<<<<<<<<<

import clr # CommonLanguage Runtime
import os

# Para trabajar con geometrias en Dynamo
clr.AddReference('ProtoGeometry')
from Autodesk.DesignScript.Geometry import *

# Para trabajar con nodos de DSCore Node: List, Math, etc
clr.AddReference('DSCoreNodes')
import DSCore
from DSCore import *

# Para trabajar con nodos nativos de Revit: Ojo con las conversiones
clr.AddReference('RevitNodes')
import Revit
clr.ImportExtensions(Revit.Elements) # nos permite trabajar con elementos
clr.ImportExtensions(Revit.GeometryConversion) # nos permite convertir geometrias

# Recurso para acceder a la API de Dynamo
clr.AddReference("DynamoRevitDS") # para acceder a la interfaz de Dynamo
import Dynamo

# Para trabajar con la RevitAPI
clr.AddReference('RevitAPI')
import Autodesk
from Autodesk.Revit.DB import *

# Para trabajar con la RevitAPIUI
clr.AddReference('RevitAPIUI') # para trabajar con la interfaz de Revit
import Autodesk
from Autodesk.Revit.UI import *

# Para trabajar contra el documento y hacer transacciones
clr.AddReference('RevitServices')
import RevitServices
from RevitServices.Persistence import DocumentManager
from RevitServices.Transactions import TransactionManager

# Identificadores
doc = DocumentManager.Instance.CurrentDBDocument # para llamar al documento
uiapp = DocumentManager.Instance.CurrentUIApplication # para actuar contra el documento
app = uiapp.Application # para trabajar con la interfaz
uidoc = uiapp.ActiveUIDocument # para seleccionar en el documento

# Mis funciones: nos podemos importar nuestro archivo llamado "Funciones.py"
import sys
sys.path.append(r"C:\Users\pasic\Documents\Dynamo\Funciones") # ruta del archivo "Funciones.py"
#import Funciones # hace referencia al archivo "Funciones.py"
#from Funciones import * # importamos las funciones que queramos o todas las funciones con el "*"

# Otras bibliotecas
import System
from System.Collections.Generic import * # Para generar iList (lista fuertemente tipada)

# Bibliotecas de Python
sys.path.append(r"C:\Python27\Lib") # aqui estan las bibliotecas que se generan al instalarse Python

# Pandas y Numpy
sys.path.append(r"C:\Users\pasic\anaconda3\envs\Dynamo383\Lib\site-packages")
import pandas as pd
import numpy as np

# FUNCIONES
# <<<<<<<<<<<<<<<<<<<<<<<<<<<<<<<<<<<<<<<<<<<<<<<<<<<<<<<<<<<<<<<<<<<<<<<<

# ENTRADA
# <<<<<<<<<<<<<<<<<<<<<<<<<<<<<<<<<<<<<<<<<<<<<<<<<<<<<<<<<<<<<<<<<<<<<<<<

vinculos = UnwrapElement(IN[0][0]) # vinculos
vincNombre = UnwrapElement(IN[0][1]) # vinculos

# CODIGO
# <<<<<<<<<<<<<<<<<<<<<<<<<<<<<<<<<<<<<<<<<<<<<<<<<<<<<<<<<<<<<<<<<<<<<<<<

# Creamos listas para almacenar informacion
# elementVincul, elementVinculCat, elementVinculCatNombre, elementVinculCatId = [], [], [], [] # listas vacias

# Colectamos instancias de vinculos
vincInstancia = FilteredElementCollector(doc).OfClass(RevitLinkInstance).ToElements()

# Obtenemos los doc de los vinculos
docvinculos = [x.GetLinkDocument() for x in vincInstancia]

# Obtenemos listado de categorias de Revit
catRevit = doc.Settings.Categories

# Obtenemos listado de nombres de categorias de Revit
# catRevitNombre = [x.Name for x in catRevit]

# Obtenemos listado de ids de categorias de Revit
# catRevitiD = [x.Id for x in catRevit]

# Obtenemos listado de categorias de modelo de Revit
catModelo = [x for x in catRevit if x.CategoryType == CategoryType.Model]

# Obtenemos listado de nombres de categorias de modelo de Revit
# catModeloNombre = [x.Name for x in catModelo]

# Obtenemos listado de ids de categorias de modelo de Revit
catModeloId = [x.Id for x in catModelo]

# Filtramos por los Id de las categories de modelo de Revit
iList_catModeloId = List[ElementId](catModeloId)
filtro = ElementMulticategoryFilter(iList_catModeloId)

# Obtenemos listado de builtincategories de Revit
# bic = System.Enum.GetValues(BuiltInCategory)

# Obtenemos listado de ids de builtincategories de Revit
# bicId = [ElementId(x) for x in bic]

# Obtener las etiquetas de valores de los enumerados (bic en este caso)
"""
for x in bic:
	try:
		bicEtiq.append(LabelUtils.GetLabelFor(x))
	except:
		pass
"""

# Obtenemos valores del DataFrame
# Leemos el archivo xlsx
df = pd.read_excel(r"C:\Users\pasic\Google Drive\0-FORMACION\ITTI-Automatizacion en Procesos BIM\RECURSOS\M11_TFM\M11_Personal\230215_M11.02\xlsx\230215_CatxVinc.xlsx", sheet_name = "Hoja1", header=0, index_col=0)

# Obtenemos los valores de cada columna (vinculo)
df_Arq = df["catModId_ARQUITECTURA"] # Vinculo Arquitectura
df_Est = df["catModId_ESTRUCTURA"] # Vinculo Estructura
df_Mep = df["catModId_MEP"] # Vinculo Instalaciones
df_Ref = df["catModId_REFERENCIA"] # Vinculo Referencia
df_Sit = df["catModId_SITUACION"] # Vinculo Situación


# Buscamos las categorias de modelo por vinculo
dict_CatxVinc = {}
for x,y in zip(docvinculos, vincNombre):

	# Colectamos instancias por documento
	elemVinc = FilteredElementCollector(x).WherePasses(filtro).WhereElementIsNotElementType().ToElements()
	
	# Obtenemos sus categorias
	# elemVincCat = [e.Category for e in elemVinc]
	
	# Obtenemos nombres de sus categorias
	# elemVincCatNombre = set([e.Category.Name for e in elemVinc])
	
	# Obtenemos ids de categorias
	elemVincCatId = set([e.Category.Id for e in elemVinc])

	# Almacenamos la informacion
	# elementVincul.append(elemVinc)
	# elementVinculCat.append(elemVincCat)
	# elementVinculCatNombre.append(elemVincCatNombre)
	# elementVinculCatId.append(elemVincCatId)

	dict_CatxVinc[y.split(".")[0]] = elemVincCatId

# Obtenemos las claves del diccionario ordenadas
dict_CatxVinc_Claves = sorted(dict_CatxVinc.keys())

# Obtenemos las columnas del excel que contienen disciplinas
columnsDisciplinas = []
for c in df.columns:
    if "_" in c:
        columnsDisciplinas.append(c)
    else:
        pass

# Comprobamos longitudes de keys y columnas
comprobKeysColumns = []
if len(dict_CatxVinc_Claves) == len(columnsDisciplinas):
    comprobKeysColumns.append("Numero de keys = Numero columnas disciplina excel")
else:
    comprobKeysColumns.append("Comprobar Numero columnas disciplinas excel")




# Accedemos a las distintas claves
idARQ = []
for k in dict_CatxVinc_Claves:
    if k == "ARQUITECTURA":
        idARQ = dict_CatxVinc[k]

idARQnoValido = []
for x in idARQ:
    if str(x) in df["catModId_ARQUITECTURA"]:
        idARQnoValido.append(x)

OUT = idARQ, idARQnoValido, df["catModId_ARQUITECTURA"]


"""
# Buscamos categorias que no pertenecen a la disciplina
prueba, arq, est, mep, ref, sit = [], [], [], [], [], []
for k,c in zip(dict_CatxVinc_Claves, columnsDisciplinas):
    if str(k) in str(c):
        #salida.append(dict_CatxVinc[k])

        for str(x) in dict_CatxVinc[k]:
            if str(x) not in df[c]:
                prueba.append(x)
"""

# OUT = dict_CatxVinc_Claves, columnsDisciplinas, dict_CatxVinc
# OUT = df["catModId_ARQUITECTURA"]
# OUT = dict_CatxVinc["ARQUITECTURA"]
# OUT = dict_CatxVinc_Claves["ARQUITECTURA"]
# OUT = dict_CatxVinc.keys(), dict_CatxVinc.values()
# ----------------------------------------

# group: DataFrame
python_script_7 = Python()  # CPython3; frozen
# ---------- python_script_7.python (151 lines) ----------
# BIBLIOTECAS
# <<<<<<<<<<<<<<<<<<<<<<<<<<<<<<<<<<<<<<<<<<<<<<<<<<<<<<<<<<<<<<<<<<<<<<<<

import clr # CommonLanguage Runtime
import os

# Para trabajar con geometrias en Dynamo
clr.AddReference('ProtoGeometry')
from Autodesk.DesignScript.Geometry import *

# Para trabajar con nodos de DSCore Node: List, Math, etc
clr.AddReference('DSCoreNodes')
import DSCore
from DSCore import *

# Para trabajar con nodos nativos de Revit: Ojo con las conversiones
clr.AddReference('RevitNodes')
import Revit
clr.ImportExtensions(Revit.Elements) # nos permite trabajar con elementos
clr.ImportExtensions(Revit.GeometryConversion) # nos permite convertir geometrias

# Recurso para acceder a la API de Dynamo
clr.AddReference("DynamoRevitDS") # para acceder a la interfaz de Dynamo
import Dynamo

# Para trabajar con la RevitAPI
clr.AddReference('RevitAPI')
import Autodesk
from Autodesk.Revit.DB import *

# Para trabajar con la RevitAPIUI
clr.AddReference('RevitAPIUI') # para trabajar con la interfaz de Revit
import Autodesk
from Autodesk.Revit.UI import *

# Para trabajar contra el documento y hacer transacciones
clr.AddReference('RevitServices')
import RevitServices
from RevitServices.Persistence import DocumentManager
from RevitServices.Transactions import TransactionManager

# Identificadores
doc = DocumentManager.Instance.CurrentDBDocument # para llamar al documento
uiapp = DocumentManager.Instance.CurrentUIApplication # para actuar contra el documento
app = uiapp.Application # para trabajar con la interfaz
uidoc = uiapp.ActiveUIDocument # para seleccionar en el documento

# Mis funciones: nos podemos importar nuestro archivo llamado "Funciones.py"
import sys
sys.path.append(r"C:\Users\pasic\Documents\Dynamo\Funciones") # ruta del archivo "Funciones.py"
#import Funciones # hace referencia al archivo "Funciones.py"
#from Funciones import * # importamos las funciones que queramos o todas las funciones con el "*"

# Otras bibliotecas
import System
from System.Collections.Generic import * # Para generar iList (lista fuertemente tipada)

# Bibliotecas de Python
sys.path.append(r"C:\Python27\Lib") # aqui estan las bibliotecas que se generan al instalarse Python

# Pandas y Numpy
sys.path.append(r"C:\Users\pasic\anaconda3\envs\Dynamo383\Lib\site-packages")
import pandas as pd
import numpy as np

# ENTRADAS
# <<<<<<<<<<<<<<<<<<<<<<<<<<<<<<<<<<<<<<<<<<<<<<<<<<<<<<<<<<<<<<<<<<<<<<<<

# CODIGO
# <<<<<<<<<<<<<<<<<<<<<<<<<<<<<<<<<<<<<<<<<<<<<<<<<<<<<<<<<<<<<<<<<<<<<<<<

# Obtenemos listado de categorias de Revit
catRevit = doc.Settings.Categories

# Obtenemos listado de categorias de modelo de Revit
catMod = [x for x in catRevit if x.CategoryType == CategoryType.Model]

# Obtenemos listado de nombres de categorias de modelo de Revit
catModNom = [x.Name for x in catRevit if x.CategoryType == CategoryType.Model]

# Obtenemos listado de ids de categorias de modelo de Revit
catModId = [x.Id for x in catRevit if x.CategoryType == CategoryType.Model]

# Creamos diccionario con claves para crear DataFrame
dictCatMod = {"catMod" : catMod, "catModNom" : catModNom, "catModId" : catModId}

df = pd.DataFrame(dictCatMod)

# Atributos de una serie
# Existen varias propiedades o métodos para ver las características de una serie:
OUT = df.size # Devuelve el número de elementos de la serie
OUT = df.index # Devuelve una lista con los nombres de las filas del DataFrame
# OUT = df.dtype # Devuelve el tipo de datos de los elementos de la serie

# Acceso a los elementos de una serie
# El acceso a los elementos puede ser a través de posiciones o través de índices (nombres)
# Acceso por posición
OUT = df[1:3].__repr__ # Devuelve otra serie con los elementos que ocupan las posiciones de la lista
# Acceso por índice
OUT = df["catModNom"].__repr__ # Devuelve el elemento con el nombre nombre en el índice
OUT = df[["catModNom", "catModId"]].__repr__ # Devuelve otra serie con los elementos correspondientes a los nombres indicadas en la lista nombres en el índice

# Resumen descriptivo de una serie
# Las siguientes funciones permiten resumir varios aspectos de una serie:
OUT = df.count() # Devuelve el número de elementos que no son nulos
OUT = df.sum() # Devuelve la suma de los datos de la serie cuando los datos son de un tipo numérico, o la concatenación de ellos cuando son del tipo cadena str
# OUT = df.cumsum() # Devuelve una serie con la suma acumulada de los datos de la serie cuando los datos son de un tipo numérico
# OUT = df.value_counts() # Devuelve una serie con la frecuencia (número de repeticiones) de cada valor de la serie
OUT = df.min() # Devuelve el menor de los datos de la serie
OUT = df.max() # Devuelve el mayor de los datos de la serie
OUT = df.mean() # Devuelve la media de los datos de la serie cuando los datos son de un tipo numérico
OUT = df.var() # Devuelve la varianza de los datos de la serie cuando los datos son de un tipo numérico
OUT = df.std() # Devuelve la desviación típica de los datos de la serie cuando los datos son de un tipo numérico
OUT = df.describe() # Devuelve una serie con un resumen descriptivo que incluye el número de datos, su suma, el mínimo, el máximo, la media, la desviación típica y los cuartiles

# Ordenar una serie
# Para ordenar una serie se utilizan los siguientes métodos:
# OUT = df.sort_values(ascending=True) # Devuelve la serie que resulta de ordenar los valores la serie. Si argumento del parámetro ascending es True el orden es creciente y si es False decreciente
OUT = df.sort_index(ascending=True) # Devuelve la serie que resulta de ordenar el índice de la serie. Si el argumento del parámetro ascending es True el orden es creciente y si es False decreciente

# Eliminar los dados desconocidos en una serie
# Los datos desconocidos representan en Pandas por NaN y los nulos por None
OUT = df.dropna() # Elimina los datos desconocidos o nulos de la serie

# Exportación de ficheros
# CSV
# OUT = df.to_csv(fichero.csv, sep=separador, columns=booleano, index=booleano) # Exporta el DataFrame df al fichero fichero.csv en formato CSV usando como separador de los datos la cadena separador
# Nota: Si se pasa True al parámetro columns se exporta también la fila con los nombres de columnas y si se pasa True al parámetro index se exporta también la columna con los nombres de las filas

# EXCEL
# OUT = df.to_excel(r"C:\Users\pasic\Google Drive\0-FORMACION\ITTI-Automatizacion en Procesos BIM\RECURSOS\M11_TFM\M11_Personal\230215_M11.02\xlsx\230215_Categorias.xlsx", sheet_name = "Hoja1") # Exporta el DataFrame df a la hoja de cálculo hoja del fichero fichero.xlsx en formato Excel
# Si se pasa True al parámetro columns se exporta también la fila con los nombres de columnas y si se pasa True al parámetro index se exporta también la columna con los nombres de las filas

# Creación de un DataFrame a partir de un fichero CSV o Excel
# EXCEL
prueba = pd.read_excel(r"C:\Users\pasic\Google Drive\0-FORMACION\ITTI-Automatizacion en Procesos BIM\RECURSOS\M11_TFM\M11_Personal\230215_M11.02\xlsx\230215_Categorias.xlsx", sheet_name = "Hoja1", header=0, index_col=0) # Devuelve un objeto del tipo DataFrame con los datos de la hoja de cálculo hoja del fichero Excel
# Nota: Como nombres de columnas se utiliza los valores de la fila n y como nombres de filas los valores de la columna m. Si no se indica m se utilizan como nombres de filas los enteros empezando en 0
# Nota: Los valores incluídos en la lista no-validos se convierten en NaN
# Nota: Para los datos numéricos se utiliza como separador de decimales el carácter indicado en separador-decimal
OUT = prueba["catModNom"].__repr__ # atacar una columna en concreto

# Atributos de un DataFrame
# Existen varias propiedades o métodos para ver las características de un DataFrame
OUT = df.info() # Devuelve información (número de filas, número de columnas, índices, tipo de las columnas y memoria usado) sobre el DataFrame
OUT = df.shape # Devuelve una tupla con el número de filas y columnas del DataFrame
OUT = df.size # Devuelve el número de elementos del DataFrame
OUT = df.columns # Devuelve una lista con los nombres de las columnas del DataFrame
OUT = df.index # Devuelve una lista con los nombres de las filas del DataFrame
OUT = df.dtypes # Devuelve una serie con los tipos de datos de las columnas del DataFrame
OUT = df.head(n=5).__repr__ # Devuelve las n primeras filas del DataFrame
OUT = df.tail(n=5).__repr__ # Devuelve las n últimas filas del DataFrame
# ----------------------------------------

# group: Pandas
python_script_8 = Python()  # CPython3; frozen; unwired: IN[0]
# ---------- python_script_8.python (156 lines) ----------
# BIBLIOTECAS
# <<<<<<<<<<<<<<<<<<<<<<<<<<<<<<<<<<<<<<<<<<<<<<<<<<<<<<<<<<<<<<<<<<<<<<<<<<<<

import clr  # CommonLanguage Runtime

# Para trabajar con la RevitAPI
clr.AddReference('RevitAPI')
import Autodesk
from Autodesk.Revit.DB import *

# Para trabajar contra el documento y hacer transacciones
clr.AddReference('RevitServices')
import RevitServices
from RevitServices.Persistence import DocumentManager
from RevitServices.Transactions import TransactionManager

# Identificadores
doc = DocumentManager.Instance.CurrentDBDocument
uiapp = DocumentManager.Instance.CurrentUIApplication
app = uiapp.Application
uidoc = uiapp.ActiveUIDocument

# Otras bibliotecas
import System
from System.Collections.Generic import * 

# Bibliotecas de Python
sys.path.append(r'C:\Python27\Lib')

# Pandas y Numpy
import sys
import clr
sys.path.append(r"C:\Users\pasic\anaconda3\envs\Dynamo383\Lib\site-packages")
import pandas as pd
import numpy as np

# CODIGO
# <<<<<<<<<<<<<<<<<<<<<<<<<<<<<<<<<<<<<<<<<<<<<<<<<<<<<<<<<<<<<<<<<<<<<<<<<<<<

# Crear DataFrame
dicc = {"Nombre": ["González, Pedro","Mota, José","Hernández, Ana"],"Edad": [25, 48, 69],"Sexo": ["masculino", "masculino", "femenino"]}
df = pd.DataFrame(dicc)
# OUT = df
# Nota: Dynamo no visualiza los valores del diccionario haciendo DataFrame

# Visualizar los datos (valores) del DataFrame
# OUT = df.__repr__
# OUT = df.values

# Obtener valores de una clave
# OUT = df["Edad"] # todas las edades
# OUT = df.Edad # todas las edades (alternativa)
# OUT = df.Edad.unique() # valores unicos de todas las edades
# OUT = df["Edad"].max() # valor maximo de las edades
# OUT = df["Edad"].min() # valor minimo de las edades

# Alternativa crear DataFrame
a = pd.DataFrame([2,3,4,5], columns = ["numeros"])
# OUT = a
# OUT = a.__repr__

# Visualizar columnas del DataFrame
# OUT = df.columns

# Visualizar los encabezados
# OUT = df.head()
# OUT = df.head().__repr__

# Importar base de datos (csv, excel...)
titanic = pd.read_csv(r"C:\Users\pasic\Google Drive\0-FORMACION\ITTI-Automatizacion en Procesos BIM\RECURSOS\M02_Python\M02_Curso\220613_M02.12\datasets-master\WorldDBTables\titanic.csv") # ruta del archivo
# OUT = titanic
# OUT = titanic.shape # obtenemos filas y columnas
# OUT = titanic.head(5).__repr__ # vemos las primeras 5 filas
# OUT = titanic.columns
# OUT = titanic["Age"] # por clave obtenemos todos los valores

# Filtrar en un DataFrame
booleano = titanic["Age"] > 35 # booleano edades mayores a 35
# OUT = booleano
mayorDe35 = titanic[titanic["Age"] > 35]
# OUT = mayorDe35.shape

clases2o3 = titanic[(titanic["Pclass"] == 2) | (titanic["Pclass"] == 3)] # "or" se representa como "|"
# clases2o3 = titanic[titanic["Pclass"].isin([2,3])] # alternativa
# OUT = clases2o3.shape

# Insertar nueva columna en un DataFrame
df["ColumnaNuevaTitanic"] = [1, 2, 3]
# OUT = df

# Redefinir valores para una clave
df["Edad"] = [23, 67, 47]
# OUT = df.__repr__

# Obtener indices (filas y columnas) concretos
# OUT = titanic.iloc[9:25, 2:6].__repr__

# Obtener datos de edades que no sean null
edadNoNull = titanic[titanic["Age"].notna()]
# OUT = edadNoNull.shape

# Sobreescribir un valor en x filas y en x columna
titanic.iloc[0:3, 3] = "anonimo" # de la fila 0 a la 3 y en la columna 3 (Name)
# OUT = titanic["Name"]

# Importar base de datos (csv, excel...)
air_quality = pd.read_csv(r"C:\Users\pasic\Google Drive\0-FORMACION\ITTI-Automatizacion en Procesos BIM\RECURSOS\M02_Python\M02_Curso\220613_M02.12\datasets-master\air_quality_no2.csv") # ruta del archivo
# OUT = air_quality
# OUT = air_quality.shape # obtenemos filas y columnas
# OUT = air_quality.head(5).__repr__ # vemos las primeras 5 filas
# OUT = air_quality.columns

# Replicar valores de columna existente (station_london) a una nueva (ColumnaNuevaAir) por un factor de 1.5
air_quality["ColumnaNuevaAir"] = air_quality["station_london"]*1.5
# OUT = air_quality["ColumnaNuevaAir"]
# OUT = air_quality.__repr__

# Crear una nueva columna mediante division
air_quality["ColumnaNuevaRatio"] = (air_quality["station_london"] / air_quality["station_paris"])
# OUT = air_quality.columns

# Renombrar columnas (2 opciones)
# Opcion1
air_quality = air_quality.rename(columns = {"station_london" : "estacion_londres", "station_paris" : "estacion_paris"})
# OUT = air_quality.columns

# Opcion2
air_quality.rename(columns = {"station_london" : "estacion_londres", "station_paris" : "estacion_paris"}, inplace = True)
# OUT = air_quality.columns

# Sacar medias
# OUT = titanic["Age"].mean() # media
# OUT = titanic["Age"].median() # mediana

# Agrupar por clave (Sex)
mediaSex = titanic.groupby("Sex").mean() # agrupamos por sexo
# OUT = mediaSex.__repr__
# OUT = mediaSex["Age"] # obtenemos la edad media en funcion del sexo

# Agrupar por claves (Sex, Pclass)
mediaSexClass = titanic.groupby(["Sex", "Pclass"]).mean() # agrupamos por sexo y clase
# OUT = mediaSexClass.__repr__
# OUT = mediaSexClass["Age"] # obtenemos la edad media en funcion del sexo y clase

# Obtener numero de valores diferentes por clave
# OUT = titanic["Pclass"].value_counts()

# Ordenar valores por clave (Edad)
porEdad = titanic.sort_values(by = "Age", ascending = True) # de mayor a menor
# OUT = porEdad.head().__repr__

# Aplicar una funcion por clave
def pordos(x):
    return x*2

# OUT = edadNoNull["Age"].apply(pordos) # multiplica cada valor de "Age" por 2
# ----------------------------------------

# group: Numpy
python_script_9 = Python()  # CPython3; frozen; unwired: IN[0]
# ---------- python_script_9.python (177 lines) ----------
# BIBLIOTECAS
# <<<<<<<<<<<<<<<<<<<<<<<<<<<<<<<<<<<<<<<<<<<<<<<<<<<<<<<<<<<<<<<<<<<<<<<<<<<<

import clr  # CommonLanguage Runtime

# Para trabajar con la RevitAPI
clr.AddReference('RevitAPI')
import Autodesk
from Autodesk.Revit.DB import *

# Para trabajar contra el documento y hacer transacciones
clr.AddReference('RevitServices')
import RevitServices
from RevitServices.Persistence import DocumentManager
from RevitServices.Transactions import TransactionManager

# Identificadores
doc = DocumentManager.Instance.CurrentDBDocument
uiapp = DocumentManager.Instance.CurrentUIApplication
app = uiapp.Application
uidoc = uiapp.ActiveUIDocument

# Otras bibliotecas
import System
from System.Collections.Generic import * 

# Bibliotecas de Python
sys.path.append(r'C:\Python27\Lib')

# Pandas y Numpy
import sys
import clr
sys.path.append(r"C:\Users\pasic\anaconda3\envs\Dynamo383\Lib\site-packages")
import pandas as pd
import numpy as np

# CODIGO
# <<<<<<<<<<<<<<<<<<<<<<<<<<<<<<<<<<<<<<<<<<<<<<<<<<<<<<<<<<<<<<<<<<<<<<<<<<<<

# Consultar informacion de numpy
# OUT = dir(np)

# Diferencia entre numpy y pandas
# numpy: trabaja con arrays
# pandas: trabaja con data frames

# Crear una matriz de numeros enteros
a = np.arange(45)
# obtenemos una matriz plana (dynamo lo traduce como una lista de 45 elementos)
# OUT = a

b = a.reshape(3, 5, 3)
# convertimos una matriz plana en una matriz con "ejes", es decir, con filas y columnas
# OUT = b
# obtenemos una lista con 3 sublistas con 5 sublistas cada una con 3 elementos cada una

# OUT = b.shape
# obtenemos la estructura de la matriz, en este caso, (3,5,3)

# OUT = b.ndim
# obtenemos el numero de dimensiones que tiene la matriz, en este caso, 3

# OUT = b.dtype
# obtenemos el tipo de datos del elemento, en este caso, int32

# OUT = b.size
# obtenemos el tamaño (numero de elementos), en este caso, 45

# OUT = type(b)
# obtenemos el tipo del elemento, en este caso, numpy.ndarray

# Crear una matriz de numeros decimales
c = np.linspace(0, 2, 3)
# Metodo "linspace()"
# OUT = c

# Convertir listas y tuplas nativas de Python en matrices
d = np.array([(1, 2, 3), (4, 5, 6)])
# Metodo "array()"
# OUT = d

# Crear una matriz de numeros complejos
e = np.array([[1, 2], [3, 4]], dtype=complex)
# OUT = e

# Crear una matriz de ceros
f = np.zeros((1, 2))
# obtenemos una matriz de ceros con 1 columna y 2 filas
# OUT = f

# Crear una matriz de unos
g = np.ones((1, 2))
# obtenemos una matriz de unos con 1 columna y 2 filas
# OUT = g

# Crear una matriz con contenido inicial aleatorio
h = np.empty((1, 2))
# obtenemos una matriz aleatoria con 1 columna y 2 filas
# OUT = h

# Operar entre arrays
a = np.array([20, 30, 40, 50])
b = np.arange(4)
c = a-b # resta
# OUT = c
# obtenemos una matriz tal que [20, 29, 38, 47]

# OUT = b**2
# obtenemos una matriz tal que [0, 29, 38, 47]

# OUT = 10 * np.sin(b)

# OUT = a < 35
# obtenemos una matriz tal que [True, True, False, False]

# OUT = a @ b
# resultado de ((20*0) + (30*1) + (40*2) + (50*3)) = 260

# OUT = a.dot(b)
# resultado de ((20*0) + (30*1) + (40*2) + (50*3)) = 260

rg = np.random.default_rng(1)
rgr = rg.random((2,3))
# OUT = rgr
# rangos aleatorios del 0 al 1 con estructura (2 columnas, 3 filas x columna)

# OUT = rgr.sum(axis = 0)
# resultado de sumar los valores de las mismas filas

# OUT = np.sqrt(rgr)
# raiz cuadrada de cada uno de los valores

# OUT = np.exp(rgr)
# exponente de cada uno de los valores

# Añadir 2 arrays con la misma estructura
a1 = np.array([20, 30, 40, 50])
a2 = np.array([40, 25, 65, 45])
# OUT = np.add(a1, a2) # seria como una suma de valores

# Utilizar numpy con funciones
def f(x,y):
    return 10*x+y

a = np.fromfunction(f, (5,4), dtype=int)
# OUT = a
# crea matriz de 5 columnas, 4 filas x columna

# OUT = a.shape
# obtenemos la estructura de la matriz (columnas y filas)

# Modificar estructura de un array
b = a.reshape(4,5)
# OUT = b

# Transponer una matriz
# OUT = b.T

# Obtener el valor minimo
# OUT = np.min(b)

# Obtener el valor maximo
# OUT = np.max(b)

# Apilar matrices (podemos apilar en vertical u horizontal)
a = np.floor(10*rg.random((2,2)))
b = np.floor(10*rg.random((2,2)))
apilarVert = np.vstack((a,b))
apilarHor = np.hstack((a,b))
# OUT =a, b, apilarVert, apilarHor

# Dividir matrices (podemos dividir en vertical u horizontal)
a = np.floor(10*rg.random((2,2)))
b = np.floor(10*rg.random((2,2)))
divVert = np.vsplit(a,2) # dividir en indice 2
divHor = np.hsplit(a,2) # dividir en indice 2
# OUT =a, b, divVert, divHor
# ----------------------------------------

python_script_10 = Python(IN[0]=python_script)  # CPython3; frozen
# ---------- python_script_10.python (182 lines) ----------
# BIBLIOTECAS
# <<<<<<<<<<<<<<<<<<<<<<<<<<<<<<<<<<<<<<<<<<<<<<<<<<<<<<<<<<<<<<<<<<<<<<<<

import clr # CommonLanguage Runtime
import os

# Para trabajar con geometrias en Dynamo
clr.AddReference('ProtoGeometry')
from Autodesk.DesignScript.Geometry import *

# Para trabajar con nodos de DSCore Node: List, Math, etc
clr.AddReference('DSCoreNodes')
import DSCore
from DSCore import *

# Para trabajar con nodos nativos de Revit: Ojo con las conversiones
clr.AddReference('RevitNodes')
import Revit
clr.ImportExtensions(Revit.Elements) # nos permite trabajar con elementos
clr.ImportExtensions(Revit.GeometryConversion) # nos permite convertir geometrias

# Recurso para acceder a la API de Dynamo
clr.AddReference("DynamoRevitDS") # para acceder a la interfaz de Dynamo
import Dynamo

# Para trabajar con la RevitAPI
clr.AddReference('RevitAPI')
import Autodesk
from Autodesk.Revit.DB import *

# Para trabajar con la RevitAPIUI
clr.AddReference('RevitAPIUI') # para trabajar con la interfaz de Revit
import Autodesk
from Autodesk.Revit.UI import *

# Para trabajar contra el documento y hacer transacciones
clr.AddReference('RevitServices')
import RevitServices
from RevitServices.Persistence import DocumentManager
from RevitServices.Transactions import TransactionManager

# Identificadores
doc = DocumentManager.Instance.CurrentDBDocument # para llamar al documento
uiapp = DocumentManager.Instance.CurrentUIApplication # para actuar contra el documento
app = uiapp.Application # para trabajar con la interfaz
uidoc = uiapp.ActiveUIDocument # para seleccionar en el documento

# Mis funciones: nos podemos importar nuestro archivo llamado "Funciones.py"
import sys
sys.path.append(r"C:\Users\pasic\Documents\Dynamo\Funciones") # ruta del archivo "Funciones.py"
#import Funciones # hace referencia al archivo "Funciones.py"
#from Funciones import * # importamos las funciones que queramos o todas las funciones con el "*"

# Otras bibliotecas
import System
from System.Collections.Generic import * # Para generar iList (lista fuertemente tipada)

# Bibliotecas de Python
sys.path.append(r"C:\Python27\Lib") # aqui estan las bibliotecas que se generan al instalarse Python

# Pandas y Numpy
sys.path.append(r"C:\Users\pasic\anaconda3\envs\Dynamo383\Lib\site-packages")
import pandas as pd
import numpy as np

# FUNCIONES
# <<<<<<<<<<<<<<<<<<<<<<<<<<<<<<<<<<<<<<<<<<<<<<<<<<<<<<<<<<<<<<<<<<<<<<<<

# ENTRADA
# <<<<<<<<<<<<<<<<<<<<<<<<<<<<<<<<<<<<<<<<<<<<<<<<<<<<<<<<<<<<<<<<<<<<<<<<

vinculos = UnwrapElement(IN[0][0]) # vinculos
vincNombre = UnwrapElement(IN[0][1]) # vinculos

# CODIGO
# <<<<<<<<<<<<<<<<<<<<<<<<<<<<<<<<<<<<<<<<<<<<<<<<<<<<<<<<<<<<<<<<<<<<<<<<

# Creamos listas para almacenar informacion
# elementVincul, elementVinculCat, elementVinculCatNombre, elementVinculCatId = [], [], [], [] # listas vacias

# Colectamos instancias de vinculos
vincInstancia = FilteredElementCollector(doc).OfClass(RevitLinkInstance).ToElements()

# Obtenemos los doc de los vinculos
docvinculos = [x.GetLinkDocument() for x in vincInstancia]

# Obtenemos listado de categorias de Revit
catRevit = doc.Settings.Categories

# Obtenemos listado de nombres de categorias de Revit
# catRevitNombre = [x.Name for x in catRevit]

# Obtenemos listado de ids de categorias de Revit
# catRevitiD = [x.Id for x in catRevit]

# Obtenemos listado de categorias de modelo de Revit
catModelo = [x for x in catRevit if x.CategoryType == CategoryType.Model]

# Obtenemos listado de nombres de categorias de modelo de Revit
# catModeloNombre = [x.Name for x in catModelo]

# Obtenemos listado de ids de categorias de modelo de Revit
catModeloId = [x.Id for x in catModelo]

# Filtramos por los Id de las categories de modelo de Revit
iList_catModeloId = List[ElementId](catModeloId)
filtro = ElementMulticategoryFilter(iList_catModeloId)

# Obtenemos listado de builtincategories de Revit
# bic = System.Enum.GetValues(BuiltInCategory)

# Obtenemos listado de ids de builtincategories de Revit
# bicId = [ElementId(x) for x in bic]

# Obtener las etiquetas de valores de los enumerados (bic en este caso)
"""
for x in bic:
	try:
		bicEtiq.append(LabelUtils.GetLabelFor(x))
	except:
		pass
"""

# Obtenemos valores del DataFrame
# Leemos el archivo xlsx
df = pd.read_excel(r"C:\Users\pasic\Google Drive\0-FORMACION\ITTI-Automatizacion en Procesos BIM\RECURSOS\M11_TFM\M11_Personal\230215_M11.02\xlsx\230215_CatxVinc.xlsx", sheet_name = "Hoja1", header=0, index_col=0)

# Obtenemos los valores de cada columna (vinculo)
df_Arq = df["catModId_ARQUITECTURA"] # Vinculo Arquitectura
df_Est = df["catModId_ESTRUCTURA"] # Vinculo Estructura
df_Mep = df["catModId_MEP"] # Vinculo Instalaciones
df_Ref = df["catModId_REFERENCIA"] # Vinculo Referencia
df_Sit = df["catModId_SITUACION"] # Vinculo Situación


# Buscamos las categorias de modelo por vinculo
dict_CatxVinc = {}
for x,y in zip(docvinculos, vincNombre):

	# Colectamos instancias por documento
	elemVinc = FilteredElementCollector(x).WherePasses(filtro).WhereElementIsNotElementType().ToElements()
	
	# Obtenemos sus categorias
	# elemVincCat = [e.Category for e in elemVinc]
	
	# Obtenemos nombres de sus categorias
	# elemVincCatNombre = set([e.Category.Name for e in elemVinc])
	
	# Obtenemos ids de categorias
	elemVincCatId = set([e.Category.Id for e in elemVinc])

	# Almacenamos la informacion
	# elementVincul.append(elemVinc)
	# elementVinculCat.append(elemVincCat)
	# elementVinculCatNombre.append(elemVincCatNombre)
	# elementVinculCatId.append(elemVincCatId)
	
	dict_CatxVinc[y.split(".")[0]] = elemVincCatId

# Obtenemos las claves del diccionario ordenadas
dict_CatxVinc_Claves = sorted(dict_CatxVinc.keys())

# Obtenemos las columnas del excel que contienen las disciplinas
columnsDisciplinas = []
for c in df.columns:
    if "_" in c:
        columnsDisciplinas.append(c)
    else:
        pass

# Buscamos categorias que no pertenecen a la disciplina
salida = []
for k,c in zip(dict_CatxVinc_Claves, columnsDisciplinas):
    if str(k) in str(columnsDisciplinas):
        for x in dict_CatxVinc["k"]:
            if x not in df["c"]:
                salida.append(x)
        #prueba.append(k)
    else:
        salida.append("No se encuentra la columna en cuestion")

OUT = salida
# ----------------------------------------

# group: Parámetros de información de Proyecto
projectInfo = Python()  # CPython3; frozen
# ---------- projectInfo.python (51 lines) ----------
# BIBLIOTECAS
# <<<<<<<<<<<<<<<<<<<<<<<<<<<<<<<<<<<<<<<<<<<<<<<<<<<<<<<<<<<<<<<<<<<<<<<<<<<<

import clr
# Importar RevitAPI
clr.AddReference("RevitAPI")
import Autodesk
from Autodesk.Revit.DB import *
import Autodesk.Revit.DB as DB

# Importar DocumentManager y TransactionManager
clr.AddReference("RevitServices")
import RevitServices
from RevitServices.Persistence import DocumentManager
from RevitServices.Transactions import TransactionManager
from System.Collections.Generic import *

import sys
sys.path.append(r'C:\Program Files (x86)\IronPython 2.7\Lib') #Bibliotecas Python
import os #Sistema Operativo
import traceback #Guardar excepciones

#Documento actual e Interfaz de Usuario.
doc =  DocumentManager.Instance.CurrentDBDocument

# CODIGO
# <<<<<<<<<<<<<<<<<<<<<<<<<<<<<<<<<<<<<<<<<<<<<<<<<<<<<<<<<<<<<<<<<<<<<<<<<<<<

# Obtenemos la informacion de proyecto
infoPro = FilteredElementCollector(doc).OfCategory(BuiltInCategory.OST_ProjectInformation).FirstElement()

TransactionManager.Instance.EnsureInTransaction(doc)
# abrimos transaccion

# Accedemos al parametro "PROJECT_NAME"
param = infoPro.get_Parameter(BuiltInParameter.PROJECT_NAME)

# Asignamos nombre al parametro "PROJECT_NAME"
param.Set("Estrella de la muerte")

# Obtener Configuracion de analisis de ruta
routeSett = Analysis.RouteAnalysisSettings.GetRouteAnalysisSettings(doc)

TransactionManager.Instance.TransactionTaskDone()
# cerramos transaccion

# SALIDA
# <<<<<<<<<<<<<<<<<<<<<<<<<<<<<<<<<<<<<<<<<<<<<<<<<<<<<<<<<<<<<<<<<<<<<<<<<<<<

# Accedemos a los parametros de informacion de proyecto
OUT = infoPro.Parameters
# ----------------------------------------

# group: IN
directory_path = Directory("C:\Habitat\Users\kevinhimmelreich\OneDrive - PROMOCIONES HABITAT SA\Escritorio\ITTI_Dynamo_Python_Abril22\TXT")

# group: Crear txt par compartidos
python_script_11 = Python(IN[0]=directory_path)  # CPython3; frozen
# ---------- python_script_11.python (43 lines) ----------
# BIBLIOTECAS
# <<<<<<<<<<<<<<<<<<<<<<<<<<<<<<<<<<<<<<<<<<<<<<<<<<<<<<<<<<<<<<<<<<<<<<<<<<<<

import clr
# Importar RevitAPI
clr.AddReference("RevitAPI")
import Autodesk
from Autodesk.Revit.DB import *
import Autodesk.Revit.DB as DB

# Importar DocumentManager y TransactionManager
clr.AddReference("RevitServices")
import RevitServices
from RevitServices.Persistence import DocumentManager
from RevitServices.Transactions import TransactionManager
from System.Collections.Generic import *

import sys
sys.path.append(r'C:\Program Files (x86)\IronPython 2.7\Lib') #Bibliotecas Python
import os #Sistema Operativo
import traceback #Guardar excepciones

#Para imprimir Bitmap
import System
#Documento actual e Interfaz de Usuario.
doc =  DocumentManager.Instance.CurrentDBDocument

# ENTRADA
# <<<<<<<<<<<<<<<<<<<<<<<<<<<<<<<<<<<<<<<<<<<<<<<<<<<<<<<<<<<<<<<<<<<<<<<<<<<<

direc = IN[0] # ruta donde ubicar el archivo txt

# CODIGO
# <<<<<<<<<<<<<<<<<<<<<<<<<<<<<<<<<<<<<<<<<<<<<<<<<<<<<<<<<<<<<<<<<<<<<<<<<<<<

# Crear txt par compartidos
fileStream = System.IO.File.Create(direc + "\\" + "ITTI_Shared.txt")
fileStream.Close()

# SALIDA
# <<<<<<<<<<<<<<<<<<<<<<<<<<<<<<<<<<<<<<<<<<<<<<<<<<<<<<<<<<<<<<<<<<<<<<<<<<<<

OUT = fileStream
# ----------------------------------------

# group: Parámetros compartidos
python_script_12 = Python()  # CPython3; frozen
# ---------- python_script_12.python (72 lines) ----------
# BIBLIOTECAS
# <<<<<<<<<<<<<<<<<<<<<<<<<<<<<<<<<<<<<<<<<<<<<<<<<<<<<<<<<<<<<<<<<<<<<<<<<<<<

import clr
# Importar RevitAPI
clr.AddReference("RevitAPI")
import Autodesk
from Autodesk.Revit.DB import *
import Autodesk.Revit.DB as DB

# Importar DocumentManager y TransactionManager
clr.AddReference("RevitServices")
import RevitServices
from RevitServices.Persistence import DocumentManager
from RevitServices.Transactions import TransactionManager
from System.Collections.Generic import *

import sys
sys.path.append(r'C:\Program Files (x86)\IronPython 2.7\Lib') #Bibliotecas Python
import os #Sistema Operativo
import traceback #Guardar excepciones

#Documento actual e Interfaz de Usuario.
doc =  DocumentManager.Instance.CurrentDBDocument

# CODIGO
# <<<<<<<<<<<<<<<<<<<<<<<<<<<<<<<<<<<<<<<<<<<<<<<<<<<<<<<<<<<<<<<<<<<<<<<<<<<<


# Sacamos un iterador
iterador = doc.ParameterBindings.ForwardIterator()
# Metodo "ForwardIterator()": Retrieve a forward moving iterator to the map
    # sin Argumentos
    # cuelga de "DefinitionBindingMap Class": A map that contains mappings of parameter definitions to parameter bindings

# Colectamos el primer elemento de los suelos
suelo = FilteredElementCollector(doc).OfClass(Floor).FirstElement()

salida = []
while iterador.MoveNext():
    nombre = iterador.Key.Name # nombres de los par compartidos
    id = iterador.Key.Id # ids de los par compartidos
    # grupoPar = iterador.Key.ParameterGroup # grupo de parametro
    grupoPar = iterador.Key.GetGroupTypeId() # alternativa grupo de parametro (ForgeTypeId)
    tipoUnidad = iterador.Key.GetDataType() # UnitType
    salida.append(nombre)

# SALIDA
# <<<<<<<<<<<<<<<<<<<<<<<<<<<<<<<<<<<<<<<<<<<<<<<<<<<<<<<<<<<<<<<<<<<<<<<<<<<<

# Obtenemos un listado de todos los parametros compartidos
OUT = iterador

# Obtenemos todos los parametros del suelo colectado
OUT = suelo.Parameters

# Obtenemos todos los par compartidos del suelo colectado
parcomp = [x for x in suelo.Parameters if x.IsShared]
OUT = parcomp

# Obtenemos todos los par no compartidos del suelo colectado
parnocomp = [x for x in suelo.Parameters if not x.IsShared]
OUT = parnocomp

TransactionManager.Instance.EnsureInTransaction(doc)
# abrimos transaccion

# Borramos par compartidos
[doc.Delete(x.Id) for x in parcomp]

TransactionManager.Instance.TransactionTaskDone()
# cerramos transaccion
# ----------------------------------------

# group: IN
archivo_txt = Filename("No hay ningún archivo seleccionado.")

# group: Parámetros compartidos
python_script_13 = Python(IN[0]=archivo_txt)  # IronPython2; frozen
# ---------- python_script_13.python (118 lines) ----------
# BIBLIOTECAS
# <<<<<<<<<<<<<<<<<<<<<<<<<<<<<<<<<<<<<<<<<<<<<<<<<<<<<<<<<<<<<<<<<<<<<<<<<<<<

import clr  # CommonLanguage Runtime

# Para trabajar con la RevitAPI
clr.AddReference('RevitAPI')
import Autodesk
from Autodesk.Revit.DB import *

# Para trabajar contra el documento y hacer transacciones
clr.AddReference('RevitServices')
import RevitServices
from RevitServices.Persistence import DocumentManager
from RevitServices.Transactions import TransactionManager
# Identificadores
doc = DocumentManager.Instance.CurrentDBDocument
uiapp = DocumentManager.Instance.CurrentUIApplication
app = uiapp.Application
uidoc = uiapp.ActiveUIDocument

# Otras bibliotecas
import System
from System.Collections.Generic import *  # Para generar iList

# CODIGO
# <<<<<<<<<<<<<<<<<<<<<<<<<<<<<<<<<<<<<<<<<<<<<<<<<<<<<<<<<<<<<<<<<<<<<<<<<<<<

# Accedemos al archivo txt que sale por defecto en nuestro documento
# sharedParam = app.OpenSharedParameterFile()
# Metodo "OpenSharedParameterFile()": Enables access to shared parameter groups and definitions that are maintained on disk
	# sin Argumentos
	# cuelga de "ControlledApplication Class": Represents the Autodesk Revit Application with no access to documents. It provides options and other application wide data and settings for external applications OnStartup/OnShutdown

# Accedemos a la ruta del archivo txt que sale por defecto en nuestro documento
archivoOrg = app.SharedParameterFileName
# Propiedad "SharedParameterFileName": Contains the fully qualified path to a shared parameters file
	# cuelga de "ControlledApplication Class": Represents the Autodesk Revit Application with no access to documents. It provides options and other application wide data and settings for external applications OnStartup/OnShutdown

# Sobreescribimos la ruta mediante el input IN[0]
app.SharedParameterFileName = IN[0]

# Accedemos a los grupos de parametros del txt
SharedParameterFile = app.OpenSharedParameterFile()
# Metodo "OpenSharedParameterFile()": Enables access to shared parameter groups and definitions that are maintained on disk
	# sin Argumentos
	# cuelga de "Application Class": Represents the Autodesk Revit Application, providing access to documents, options and other application wide data and settings

# Seleccionamos el grupo de parametros "Dynamo" dentro del txt
grupo = SharedParameterFile.Groups.get_Item("Dynamo")

# Creamos un nuevo grupo de parametros "ITTI_2022"
SharedParameterFile.Groups.Create("ITTI_2022")

# Seleccionar el parametro compartido "PruebaCargaDynamo" dentro del grupo "Dynamo"
definicion = grupo.Definitions.get_Item("PruebaCargaDynamo")

# Crear parametro compartido "External Definition" en el txt
# Crear opciones y definicion 2021
opc2021 = ExternalDefinitionCreationOptions("NombreParam", ParameterType.Text)
opc2021.UserModificable = True
opc2021.Description = "Parametro añadido desde Python"
definicion = grupo.Definition.Create(opc2021)

# Version Revit 2022 en adelante
opc2022 = ExternalDefinitionCreationOptions("NombreParam", SpecTypeId.String.Text)
opc2022.UserModificable = True
opc2022.Description = "Parametro creado desde Python"
definicion = grupo.Definitions.Create(opc2022)

# Categorias a las que asignar el parametro
# Creamos conjunto de categorias fuertemente tipado
catSet1 = app.Create.NewCategorySet()
# Metodo "NewCategorySet()": Creates a new instance of a set specifically for holding category objects
	# sin Argumentos
	# cuelga de "Application Class": Represents the Autodesk Revit Application, providing access to documents, options and other application wide data and settings

# Creamos conjunto de categorias fuertemente tipado (alternativa a "NewCategorySet()")
catSet2 = CategorySet()

# Obtenemos la categoria de suelos desde su BuiltInCategory
cat = Category.GetCategory(doc, BuiltInCategory.OST_Floors)

# Insertamos la categoria en el conjunto
catSet1.Insert(cat)
catSet2.Insert(cat)

# Crear enlace "Binding"
# TypeBinding: para parametros de Tipo
typBin1 = app.Create.NewTypeBinding(catSet1)
typBin2 = TypeBinding(catSet2)

# InstanceBinding: para parametros de Ejemplar
insBin1 = app.Create.NewInstanceBinding(catSet1)
insBin2 = InstanceBinding(catSet2)

# Definimos el "Agrupar parametro en", en este caso "Texto"
grupoDeseado = BuiltInParameterGroup.PG_TEXT

# Cuando no queremos asignar ningun grupo
# BuiltInParameterGroup.INVALID

TransactionManager.Instance.EnsureInTransaction(doc)
# abrimos transaccion

# Insertamos el parametro compartido como parametro de proyecto
doc.ParameterBindings.Insert(definicion, insBin2, grupoDeseado)

# Reinsertar un parametro compartido como parametro de proyecto porque se ha modificado
doc.ParameterBindings.ReInsert(definicion, insBin2, grupoDeseado)

TransactionManager.Instance.TransactionTaskDone()
# cerramos transaccion

# SALIDA
# <<<<<<<<<<<<<<<<<<<<<<<<<<<<<<<<<<<<<<<<<<<<<<<<<<<<<<<<<<<<<<<<<<<<<<<<<<<<

OUT = insBin1, insBin2
# ----------------------------------------

# group: 220629_M03.08
clase = StringInput("220629_M03.08")

# group: IN
archivo_txt_2 = Filename("..\txt\230315_ParamComp.txt")

# group: Parámetros compartidos
python_script_14 = Python(IN[0]=archivo_txt_2)  # CPython3
# ---------- python_script_14.python (168 lines) ----------
# BIBLIOTECAS
# <<<<<<<<<<<<<<<<<<<<<<<<<<<<<<<<<<<<<<<<<<<<<<<<<<<<<<<<<<<<<<<<<<<<<<<<<<<<

import clr  # CommonLanguage Runtime

# Para trabajar con la RevitAPI
clr.AddReference('RevitAPI')
import Autodesk
from Autodesk.Revit.DB import *

# Para trabajar contra el documento y hacer transacciones
clr.AddReference('RevitServices')
import RevitServices
from RevitServices.Persistence import DocumentManager
from RevitServices.Transactions import TransactionManager
# Identificadores
doc = DocumentManager.Instance.CurrentDBDocument
uiapp = DocumentManager.Instance.CurrentUIApplication
app = uiapp.Application
uidoc = uiapp.ActiveUIDocument

# Otras bibliotecas
import System
from System.Collections.Generic import *  # Para generar iList

# CODIGO
# <<<<<<<<<<<<<<<<<<<<<<<<<<<<<<<<<<<<<<<<<<<<<<<<<<<<<<<<<<<<<<<<<<<<<<<<<<<<

# Accedemos al archivo txt que sale por defecto en nuestro documento
# sharedParam = app.OpenSharedParameterFile()

# Accedemos a la ruta del archivo txt que sale por defecto en nuestro documento
archivoOrig = app.SharedParametersFilename

# Sobreescribimos la ruta mediante el input IN[0]
archivoOrig = IN[0]

# Abrimos el archivo enlazado
sharedParam = app.OpenSharedParameterFile()

# Creamos el grupo de parametros del txt si no existe
if sharedParam.Groups.get_Item("ClashDetection"):
    grupo3D = sharedParam.Groups.get_Item("ClashDetection")
else:
    grupo3D = sharedParam.Groups.Create("ClashDetection")

# Crear parametro compartido "External Definition" en el txt si no existe
# Version Revit 2022 en adelante
if grupo3D.Definitions.get_Item("3D"):
    definicion = grupo3D.Definitions.get_Item("3D")
else:
    extOpc = ExternalDefinitionCreationOptions("3D", SpecTypeId.String.Text)
    extOpc.UserModificable = True
    extOpc.Description = "Parametro añadido desde Python"
    definicion = grupo3D.Definitions.Create(extOpc)

# Creamos conjunto de categorias fuertemente tipado
catSet = app.Create.NewCategorySet()

# Obtenemos las categorias desde su BuiltInCategory
# Arquitectura
catSet.Insert(Category.GetCategory(doc, BuiltInCategory.OST_Floors))
catSet.Insert(Category.GetCategory(doc, BuiltInCategory.OST_Ramps))
catSet.Insert(Category.GetCategory(doc, BuiltInCategory.OST_Windows))
catSet.Insert(Category.GetCategory(doc, BuiltInCategory.OST_Doors))
catSet.Insert(Category.GetCategory(doc, BuiltInCategory.OST_Ceilings))
catSet.Insert(Category.GetCategory(doc, BuiltInCategory.OST_CurtainWallPanels))
catSet.Insert(Category.GetCategory(doc, BuiltInCategory.OST_CurtainWallMullions))
# catSet.Insert(Category.GetCategory(doc, BuiltInCategory.OST_Railings))
# catSet.Insert(Category.GetCategory(doc, BuiltInCategory.OST_Roofs))
# catSet.Insert(Category.GetCategory(doc, BuiltInCategory.OST_Stairs))
# catSet.Insert(Category.GetCategory(doc, BuiltInCategory.OST_Walls))

# Estructura
catSet.Insert(Category.GetCategory(doc, BuiltInCategory.OST_StructuralFoundation))
catSet.Insert(Category.GetCategory(doc, BuiltInCategory.OST_StructuralFraming))
catSet.Insert(Category.GetCategory(doc, BuiltInCategory.OST_StructuralColumns))
catSet.Insert(Category.GetCategory(doc, BuiltInCategory.OST_Columns))
# catSet.Insert(Category.GetCategory(doc, BuiltInCategory.OST_CeilingsStructure))
# catSet.Insert(Category.GetCategory(doc, BuiltInCategory.OST_StructuralTendons))
# catSet.Insert(Category.GetCategory(doc, BuiltInCategory.OST_StructuralTruss))
# catSet.Insert(Category.GetCategory(doc, BuiltInCategory.OST_StructuralFramingSystem))
catSet.Insert(Category.GetCategory(doc, BuiltInCategory.OST_TemporaryStructure))
# catSet.Insert(Category.GetCategory(doc, BuiltInCategory.OST_FloorsStructure))
# catSet.Insert(Category.GetCategory(doc, BuiltInCategory.OST_RoofsStructure))
# catSet.Insert(Category.GetCategory(doc, BuiltInCategory.OST_WallsStructure))

# MEP
catSet.Insert(Category.GetCategory(doc, BuiltInCategory.OST_PipeCurves))
catSet.Insert(Category.GetCategory(doc, BuiltInCategory.OST_PipeFitting))
catSet.Insert(Category.GetCategory(doc, BuiltInCategory.OST_PipeAccessory))
catSet.Insert(Category.GetCategory(doc, BuiltInCategory.OST_FlexPipeCurves))
catSet.Insert(Category.GetCategory(doc, BuiltInCategory.OST_DuctCurves))
catSet.Insert(Category.GetCategory(doc, BuiltInCategory.OST_DuctFitting))
catSet.Insert(Category.GetCategory(doc, BuiltInCategory.OST_DuctAccessory))
catSet.Insert(Category.GetCategory(doc, BuiltInCategory.OST_FlexDuctCurves))
catSet.Insert(Category.GetCategory(doc, BuiltInCategory.OST_DuctTerminal))
catSet.Insert(Category.GetCategory(doc, BuiltInCategory.OST_MechanicalEquipment))
catSet.Insert(Category.GetCategory(doc, BuiltInCategory.OST_PlumbingFixtures))
catSet.Insert(Category.GetCategory(doc, BuiltInCategory.OST_Sprinklers))
catSet.Insert(Category.GetCategory(doc, BuiltInCategory.OST_CableTray))
catSet.Insert(Category.GetCategory(doc, BuiltInCategory.OST_CableTrayFitting))
catSet.Insert(Category.GetCategory(doc, BuiltInCategory.OST_Conduit))
catSet.Insert(Category.GetCategory(doc, BuiltInCategory.OST_ConduitFitting))
catSet.Insert(Category.GetCategory(doc, BuiltInCategory.OST_ElectricalEquipment))
catSet.Insert(Category.GetCategory(doc, BuiltInCategory.OST_LightingDevices))
catSet.Insert(Category.GetCategory(doc, BuiltInCategory.OST_LightingFixtures))
catSet.Insert(Category.GetCategory(doc, BuiltInCategory.OST_DataDevices))
catSet.Insert(Category.GetCategory(doc, BuiltInCategory.OST_FireAlarmDevices))
catSet.Insert(Category.GetCategory(doc, BuiltInCategory.OST_ElectricalFixtures))
catSet.Insert(Category.GetCategory(doc, BuiltInCategory.OST_SpecialityEquipment))
catSet.Insert(Category.GetCategory(doc, BuiltInCategory.OST_MedicalEquipment))

# Creamos enlace "Binding"
# TypeBinding: para parametros de Tipo
# InstanceBinding: para parametros de Ejemplar
insBin = app.Create.NewInstanceBinding(catSet)

# Definimos el "Agrupar parametro en", en este caso "Otros"
grupoProp = BuiltInParameterGroup.PG_TEXT

TransactionManager.Instance.EnsureInTransaction(doc)
# abrimos transaccion

# Insertamos el parametro compartido como parametro de proyecto en el documento
doc.ParameterBindings.Insert(definicion, insBin, grupoProp)

# Reinsertar un parametro compartido como parametro de proyecto porque se ha modificado
# doc.ParameterBindings.ReInsert(definicion, insBin, grupoProp)

TransactionManager.Instance.TransactionTaskDone()
# cerramos transaccion

# Insertamos el parametro compartido como parametro de proyecto en los vinculos
# Colectamos los documentos de los vinculos
vinculos = FilteredElementCollector(doc).OfClass(RevitLinkInstance)
docVinculos = [v.GetLinkDocument() for v in vinculos]
PathdocVinculos = [v.GetLinkDocument().PathName for v in vinculos]

TransactionManager.Instance.ForceCloseTransaction()
# forzamos transaccion

for x in PathdocVinculos:
    linkDoc = app.OpenDocumentFile(x)
    
    
    
    linkDoc.Close()
    linkDoc.Reload()






"""
TransactionManager.Instance.EnsureInTransaction(doc)
# abrimos transaccion

for d in docVinculos:
    d.ParameterBindings.Insert(definicion, insBin, grupoProp)

TransactionManager.Instance.TransactionTaskDone()
# cerramos transaccion

# SALIDA
# <<<<<<<<<<<<<<<<<<<<<<<<<<<<<<<<<<<<<<<<<<<<<<<<<<<<<<<<<<<<<<<<<<<<<<<<<<<<
"""
# ----------------------------------------
